# Grasshopper definition ModelFixing.gh (Grasshopper 1.0.7)
# plug-ins: Bifocals

curve = Curve([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])
end_points = EndPoints(Curve=curve)  # -> Start, End
closed = Closed(Curve=curve)  # -> Closed, Periodic
line = Line(StartPoint=end_points.Start, EndPoint=end_points.End)
join_curves = JoinCurves(Curves=[curve, line], Preserve=False)
data = Data(join_curves)
