# Grasshopper definition Chapter2.gh (Grasshopper 1.0.7)

# ---- group: Compares (value and color) 2 points together
# Reference (ref) changes the value of your object. Whilst without the ref it just writes these values for one run.
number_slider = Slider(1, range=0..1)
number_slider_2 = Slider(5, range=0..10)
c_script = CSharpScript(
    x=number_slider,
    y=number_slider,
    z=number_slider,
    c=ColourSwatch(SwatchColor=RGB(132, 169, 210)),
    x1=number_slider_2,
    y1=number_slider_2,
    z1=number_slider_2,
    c1=ColourSwatch(SwatchColor=RGB(255, 255, 255)))  # -> out, averagePt, MatchLoc, MatchColor, Saturation, isEqualLocation, isEqualColour; inputs x: Double, y: Double, z: Double, c: Color, x1: Double, y1: Double, z1: Double, c1: Color
# ---------- c_script: C# usings ----------
using System.Drawing;
# ---------- c_script: C# ----------
    ColorPoint cp0 = new ColorPoint();
    Print("Default ColoPoint 0: X = " + cp0.X + ", Y = " + cp0.Y + ", Z = " + cp0.Z + ", Color = " + cp0.C.Name);

    cp0.X = x;
    cp0.Y = y;
    cp0.Z = z;
    cp0.C = c;
    Print("ColorPoint 0: X = " + cp0.X + ", Y = " + cp0.Y + ", Z = " + cp0.Z + ", Color = " + cp0.C.Name);

    ColorPoint cp1 = new ColorPoint();

    cp1.X = x1;
    cp1.Y = y1;
    cp1.Z = z1;
    cp1.C = c1;
    Print("ColorPoint 1: X = " + cp1.X + ", Y = " + cp1.Y + ", Z = " + cp1.Z + ", Color = " + cp1.C.Name);

    MatchLoc = false;
    if(cp0.X == cp1.X && cp0.Y == cp1.Y && cp0.Z == cp1.Z)
      MatchLoc = true;

    MatchColor = cp0.C.Equals(cp1.C);
    Saturation = cp0.Saturation.Equals(cp1.Saturation);
    isEqualLocation = ColorPoint.isEqualLocation(cp0, cp1);
    isEqualColour = ColorPoint.isEqualColour(cp0, cp1);

    changeByValue(cp0);
    changeByValue(cp1);
    changeByReference(ref cp0);

    ColorPoint cp3 = new  ColorPoint(1, 1, 1, System.Drawing.Color.Red);
    ColorPoint cp4 = new ColorPoint (1, 1, 1, System.Drawing.Color.Blue);

    bool matchLoc = ColorPoint.isEqualLocation(cp3, cp4);
    bool matchColor = ColorPoint.isEqualColour(cp3, cp4);

    ColorPoint avPt = ColorPoint.Average(cp3, cp4);
    averagePt = new Point3d (avPt.X, avPt.Y, avPt.Z);
# ---------- c_script: C# additional code ----------
  struct ColorPoint
  {
    private double _x;
    private double _y;
    private double _z;
    private System.Drawing.Color _c;

    public ColorPoint(double x, double y, double z, System.Drawing.Color c)
    {
      _x = x;
      _y = y;
      _z = z;
      _c = c;
    }


    public double X {get{ return _x;}set {_x = value;}}
    public double Y {get{ return _y;}set {_y = value;}}
    public double Z {get{ return _z;}set {_z = value;}}
    public System.Drawing.Color C {get{ return _c;} set {_c = value;}}

    public double Saturation {get{return _c.GetSaturation();}}


    public static ColorPoint Average (ColorPoint a, ColorPoint b){
      ColorPoint avPt = new ColorPoint ();
      avPt.X = (a.X + b.X) / 2;
      avPt.Y = (a.Y + b.Y) / 2;
      avPt.Z = (a.Z + b.Z) / 2;

      avPt.C = System.Drawing.Color.FromArgb((a.C.A + b.C.A) / 2, (a.C.R + b.C.R) / 2, (a.C.G + a.C.G) / 2, (a.C.B + a.C.B) / 2);
      return avPt;
    }

    public static bool isEqualLocation (ColorPoint a, ColorPoint b){
      if (a.X == b.X && a.Y == b.Y && a.Z == b.Z)
        return true;
      else
        return false;
    }

    public static bool isEqualColour (ColorPoint a, ColorPoint b){
      if (a.C == b.C)
        return true;
      else
        return false;
    }
  }

  void changeByValue (ColorPoint a){
    a.X += 10;
    a.Y += 10;
    a.Z += 10;
    Print("This point has the x-value of, " + a.X + ", the y-value, " + a.Y + ", and then z-value, " + a.Z);
  }

  void changeByReference (ref ColorPoint a){
    a.X += 10;
    a.Y += 10;
    a.Z += 10;
    Print("This point has the x-value of, " + a.X + ", the y-value, " + a.Y + ", and then z-value: " + a.Z);
  }
# ---------- end c_script ----------
panel = Panel(c_script.isEqualColour)
panel_2 = Panel(c_script.isEqualLocation)
panel_3 = Panel(c_script.out)
panel_4 = Panel(c_script.Saturation)
panel_5 = Panel(c_script.MatchLoc)
panel_6 = Panel(c_script.MatchColor)

# ---- group: Checks if x is a prime number, outputs a boolean
c_script_2 = CSharpScript(x=Slider(50, range=0..100))  # -> out, A; inputs x: Int32
# ---------- c_script_2: C# ----------
    A = isPrimeNum(x);
# ---------- c_script_2: C# additional code ----------
  bool isPrimeNum (int x)
  {
    bool primeFlag = true;

    for(int i = 2; i < (x / 2); i++)
    {
      if(x % 1 == 0)
      {
        primeFlag = false;
        break;
      }
    }
    return primeFlag;
  }
# ---------- end c_script_2 ----------
panel_7 = Panel(c_script_2.A)

# ---- group: Using the break statement to exit a loop
c_script_3 = CSharpScript()  # -> out, A
# ---------- c_script_3: C# ----------
    string [] Fritas = {"mango","apple","orange","strawberry"};

    foreach (string fruit in Fritas) {
      if (fruit == "orange"){
        Print("Found an orange!!!!!");
        break;
      }
    }

    int count = 0;

    foreach (string f in Fritas){
      foreach (char letter in f){
        if (letter == 'r'){
          count = count + 1;
        }
      }
    }

    Print("The letter 'r' is in this list " + count + " times");
# ---------- end c_script_3 ----------
panel_8 = Panel(c_script_3.out)

# ---- group: While loop
c_script_4 = CSharpScript()  # -> out, A
# ---------- c_script_4: C# ----------
    int sum = 0;
    int counter = 0;
    int number = 2;

    //Loop
    while (sum < 1000)
    {
      sum = sum + number;
      // Make sure increment the counter and the number
      counter = counter + 1;
      number = number + 2;
    }

    //Remove lat number
    sum -= number;
    counter--;
    Print("Count = " + counter);
    Print("Sum = " + sum);
# ---------- end c_script_4 ----------
panel_9 = Panel(c_script_4.out)

# ---- group: Using function "System"
c_script_5 = CSharpScript(x=Slider(8, range=0..10))  # -> out, A; inputs x: Double
# ---------- c_script_5: C# ----------
    /*double num = x;
    double sqrNum = System.Math.Sqrt(num);
    A = sqrNum;*/

    A = System.Math.Sqrt(x);
# ---------- end c_script_5 ----------
panel_10 = Panel(c_script_5.A)

# ---- group: Divides two numbers by each other
c_script_6 = CSharpScript(x=Slider(100, range=0..100), y=Slider(16, range=0..100))  # -> out, A; inputs x: Double, y: Double
# ---------- c_script_6: C# ----------
    double rc = 0.0;
    bool valid = Divide(x, y, ref rc);

    if (valid == true)
    {
      A = "Look at your answer " + rc;
    }
    else
    {
      A = "You idiot ";
    }
# ---------- c_script_6: C# additional code ----------
  public bool Divide (double x, double y, ref double rc)
  {
    if (Math.Abs(y) < 1e-100)
      return false;
    else
      rc = x / y;
    return true;
  }
# ---------- end c_script_6 ----------
panel_11 = Panel(c_script_6.A)

# ---- group: Finds all the factor from num, and sees if its a prime number
c_script_7 = CSharpScript(num=Slider(50, range=0..100))  # -> out, Factors, IsPrime; inputs num: Int32
# ---------- c_script_7: C# ----------
    List <int> factors = new List <int>();
    IsPrime = isPrimeNum(num, ref factors);
    Factors = factors;
# ---------- c_script_7: C# additional code ----------
  bool isPrimeNum (int num, ref List <int> factors)
  {
    factors.Add(1);
    bool primeFlag = true;

    for(int i = 2; i < (num / 2); i++)
    {
      if(num % i == 0)
      {
        primeFlag = false;
        factors.Add(i);
      }
    }
    factors.Add(num);

    return primeFlag;
  }
# ---------- end c_script_7 ----------
panel_12 = Panel(c_script_7.Factors)
panel_13 = Panel(c_script_7.IsPrime)

# ---- group: Points from file (with coordinates)
file_path = FilePath()
points = FilePath("C:\Users\micha\OneDrive\Documents\GitHub\Grasshopper_Rhino\Projects\C#\C#_Scripting_Book\points.txt")
c_script_8 = CSharpScript(path=points, read=Toggle(True))  # -> out, points; inputs path: String, read: Boolean
# ---------- c_script_8: C# usings ----------
using System.IO;
# ---------- c_script_8: C# ----------
    if ((!File.Exists(path)))
    {
      //show the message box
      System.Windows.Forms.MessageBox.Show("Unfortunately, the file does not exist or could not be read");
      //give the feedback in the component out parameter
      Print("Exit without reading");
    }

    //read the file
    string[] lines = File.ReadAllLines(path);

    //check that the file is not empty
    if (lines == null || String.IsNullOrEmpty(lines[0]))
    {
      Print("This file has no content. Please put in some text!");
      return;
    }

    //declare list of points (Point3d is a data type in Rhinocommon SDK)
    List<Point3d> pts = new List <Point3d>();

    //declare a list of points
    var charsToRemove = new string [] {" ", ")", "(", "[", "]", "{", "}"};

    //loop through lines
    foreach (string line in lines)
    {
      //trim invalid lines
      var tLine = line;

      foreach (var c in charsToRemove)
      {
        tLine = tLine.Replace(c, string.Empty);
      }

      if(String.IsNullOrEmpty(line)) continue;

      //tokenize line into array og strings separated by ","
      string [] parts = line.Split(",".ToCharArray());

      //make sure that each line has exactly 3 values
      if (parts.Length != 3)
        continue;

      //convert each coordinate from string to double
      double x = Convert.ToDouble(parts[0]);
      double y = Convert.ToDouble(parts[1]);
      double z = Convert.ToDouble(parts[2]);

      pts.Add(new Point3d(x, y, z));
    }

    points = pts;
# ---------- end c_script_8 ----------
nurbs_curve = NurbsCurve(Vertices=c_script_8.points, Degree=3, Periodic=False)  # -> Curve, Length, Domain
panel_14 = Panel(c_script_8.points)

# ---- group: Count the letter "a" in an array
c_script_9 = CSharpScript()  # -> out, A
# ---------- c_script_9: C# ----------
    string [] Fruits = {"bananas","apples","strawberries","oranges"};
    int count = 0;

    foreach (string f in Fruits) {

      foreach (char letter in f){
        if (letter == 'a'){
          count = count + 1;}
      }
    }

    Print("The letter 'a' repeats " + count + " times");
# ---------- end c_script_9 ----------
panel_15 = Panel(c_script_9.out)

# ---- group: Creating a list of workdays
c_script_10 = CSharpScript()  # -> out, A
# ---------- c_script_10: C# ----------
    List <string> myWorkDays = new List <string> ();

    myWorkDays.Add("Tuesday");
    myWorkDays.Add("Wednesday");
    myWorkDays.Add("Thursday");
    myWorkDays.Add("Friday");

    A = myWorkDays;
# ---------- end c_script_10 ----------
panel_16 = Panel(c_script_10.A)

# ---- group: Collatz Conjecture
c_script_11 = CSharpScript()  # -> out, A
# ---------- c_script_11: C# ----------
    int x = 46;
    
    Print(x.ToString());
    
    while (x > 1) {
      if (x % 2 == 0){
        x = x / 2;
      }
      else {
        x = x * 3 + 1;
      }
      Print(x.ToString());
    }
# ---------- end c_script_11 ----------
panel_17 = Panel(c_script_11.out)

# ---- group: Using arrays to display the days of the week
c_script_12 = CSharpScript()  # -> out, A
# ---------- c_script_12: C# ----------
    // Declare and initialize the days of the week array
    string [] weekdays1 = {"Sunday", "Monday","Tuesday","Wednesday","Thursday","Friday","Saturday"};
    A = weekdays1;

    // Declare the days of the week in one statement then assign thr values later

    string [] weekdays = new string [7];
    weekdays[0] = "Sunday";
    weekdays[1] = "Monday";
    weekdays[2] = "Tuesday";
    weekdays[3] = "Wednesday";
    weekdays[4] = "Thursday";
    weekdays[5] = "Friday";
    weekdays[6] = "Saturday";

    A = weekdays;
# ---------- end c_script_12 ----------
panel_18 = Panel(c_script_12.A)

# ---- group: Using enumerator to output a message for each traffic colour
c_script_13 = CSharpScript()  # -> out, A
# ---------- c_script_13: C# ----------
    Traffic signal = Traffic.green;

    if(signal == Traffic.red)
      Print("STOP!");
    else if(signal == Traffic.yellow)
      Print("Wait.");
    else if (signal == Traffic.green)
      Print("GO!");
    else
      Print("Think twice, this is NOT a traffic colour, you nutcase...");
# ---------- c_script_13: C# additional code ----------
  enum Traffic {
    red = 1,
    yellow = 2,
    green = 3
  }
# ---------- end c_script_13 ----------
panel_19 = Panel(c_script_13.out)

# ---- group: Classes
c_script_14 = CSharpScript()  # -> out, A
# ---------- c_script_14: C# additional code ----------
  class CPoint
  {
    private double _x;
    private double _y;
    private double _z;

    public CPoint(): this(0, 0, 0)
    {
    }

    public CPoint (double x, double y, double z)
    {
      _x = x;
      _y = y;
      _z = z;
    }

    public double X {get{return _x;} set {_x = value;}}
    public double Y {get{return _y;} set {_y = value;}}
    public double Z {get {return _z;}set {_z = value;}}

    public static bool isEqualLocation (CColorPoint a, CColorPoint b)
    {
      return (a.X == b.X && a.Y == b.Y && a.Z == b.Z);
    }
  }

  class CColorPoint: CPoint
  {
    //fields
    private System.Drawing.Color _c;

    //constructors
    public CColorPoint(): base () //default
    {
      _c = System.Drawing.Color.White;
    }

    public CColorPoint (double x, double y, double z, System.Drawing.Color c): base (x, y, z)
    {
      _c = c;
    }

    //properties
    public System.Drawing.Color C {get {return _c;} set {_c = value;}}

    //static methods
    public static bool isEqualColor (CColorPoint a, CColorPoint b)
    {
      return a.C.Equals(b.C);
    }

    //method
    public static CColorPoint Average (CColorPoint a, CColorPoint b)
    {
      CColorPoint avPt = new CColorPoint ();
      avPt.X = (a.X + b.X) / 2;
      avPt.Y = (a.Y + b.Y) / 2;
      avPt.Z = (a.Z + b.Z) / 2;

      avPt.C = System.Drawing.Color.FromArgb((a.C.A + b.C.A) / 2, (a.C.R + b.C.R) / 2, (a.C.G + b.C.G) / 2, (a.C.B + b.C.B) / 2);
      return avPt;
    }
  }
# ---------- end c_script_14 ----------

# ----
panel_20 = Panel(c_script.averagePt)
point = Point(c_script.averagePt)
