# Grasshopper definition Chapter3.gh (Grasshopper 1.0.7)

# ---- group: Create new Point
number_slider = Slider(51.27, range=0..100)  # disabled
# Doubleclick Me!
number_slider_2 = Slider(19.63, range=0..100)  # disabled
number_slider_3 = Slider(79.63, range=0..100)  # disabled
c_script = CSharpScript(x=number_slider_2, y=number_slider, z=number_slider_3)  # -> out, Point; inputs x: Double, y: Double, z: Double; disabled
# ---------- c_script: C# ----------
    //create an instance of a point and initialize to x,y, and z
    Point3d pt = new Point3d (x, y, z);
    
    //assign the point "pt" to output
    Point = pt;
# ---------- end c_script ----------
panel = Panel(c_script.Point)  # disabled

# ---- group: Dissecting the Point, taking out x, y, and z
point = Point(Point(19.63, 51.27, 79.63))  # disabled
c_script_2 = CSharpScript(pt=point)  # -> out, A, B, C; inputs pt: Point3d; disabled
# ---------- c_script_2: C# ----------
    A = pt.X;
    B = pt.Y;
    C = pt.Z;
# ---------- end c_script_2 ----------
panel_2 = Panel(c_script_2.C)  # disabled
panel_3 = Panel(c_script_2.A)  # disabled
panel_4 = Panel(c_script_2.B)  # disabled

# ---- group: Creating new Point, first making it null then adding the points in there
number_slider_4 = Slider(3.1, range=0..10)  # disabled
number_slider_5 = Slider(2.1, range=0..10)  # disabled
number_slider_6 = Slider(4.1, range=0..10)  # disabled
c_script_3 = CSharpScript(x=number_slider_5, y=number_slider_4, z=number_slider_6)  # -> out, Point; inputs x: Double, y: Double, z: Double; disabled
# ---------- c_script_3: C# ----------
    //declare a new point
    Point3d newPoint = new Point3d (Point3d.Unset);

    //set "newPoint" coordinates
    newPoint.X = x;
    newPoint.Y = y;
    newPoint.Z = z;

    //assign the point coordinates to output
    Point = newPoint;
# ---------- end c_script_3 ----------
panel_5 = Panel(c_script_3.Point)  # disabled

# ---- group: Get the origin points
c_script_4 = CSharpScript()  # -> out, Origin; disabled
# ---------- c_script_4: C# ----------
    Origin = Point3d.Origin;
# ---------- end c_script_4 ----------
panel_6 = Panel(c_script_4.Origin)  # disabled

# ---- group: Creating a point and finding the distance of it to another point
point_2 = Point(Point(0, 5, 0))  # disabled
number_slider_7 = Slider(3, range=1..10)  # disabled
number_slider_8 = Slider(2, range=1..10)  # disabled
number_slider_9 = Slider(1, range=1..10)  # disabled
panel_7 = Panel(point_2)  # disabled
c_script_5 = CSharpScript(x=number_slider_9, y=number_slider_8, z=number_slider_7, other=panel_7)  # -> out, Point, Distance; inputs x: Double, y: Double, z: Double, other: Point3d; disabled
# ---------- c_script_5: C# ----------
    Point3d pt = new Point3d(x, y, z);
    double dist = pt.DistanceTo(other);
    Point = pt;
    Distance = dist;
# ---------- end c_script_5 ----------
panel_8 = Panel(c_script_5.Point)  # disabled
panel_9 = Panel(c_script_5.Distance)  # disabled

# ---- group: Moving point by Transform (Vector3d)
panel_10 = Panel("4,5,6")  # disabled
move = Move(Motion=panel_10)  # -> Geometry, Transform; disabled
point_3 = Point(Point(0, 5, 0))  # disabled
c_script_6 = CSharpScript(Point=point_3, xform=move.Transform)  # -> out, newPt; inputs Point: Point3d, xform: Transform; disabled
# ---------- c_script_6: C# ----------
    Point3d pt = new Point3d(Point);
    pt.Transform(xform);
    newPt = pt;
# ---------- end c_script_6 ----------
panel_11 = Panel(c_script_6.newPt)  # disabled

# ---- group: Checks if the list of points are co-planar
panel_12 = Panel("""4,5,6
1,1,6
0,0,6""")  # disabled
panel_13 = Panel("0.01")  # disabled
c_script_7 = CSharpScript(pts=panel_12, tolerance=panel_13)  # -> out, IsCoPlanar; inputs pts: list of Point3d, tolerance: Double; disabled
# ---------- c_script_7: C# ----------
    //Test if the list of input points are coplanar
    bool coplaner = Point3d.ArePointsCoplanar(pts, tolerance);
    
    //assign the co-planar test to output
    IsCoPlanar = coplaner;
# ---------- end c_script_7 ----------
panel_14 = Panel(c_script_7.IsCoPlanar)  # disabled

# ---- group: Sums two points together
panel_15 = Panel("1,2,3")  # disabled
panel_16 = Panel("3,2,1")  # disabled
c_script_8 = CSharpScript(pt1=panel_16, pt2=panel_15)  # -> out, sumpt; inputs pt1: Point3d, pt2: Point3d; disabled
# ---------- c_script_8: C# ----------
    sumpt = pt1 + pt2;
# ---------- end c_script_8 ----------
panel_17 = Panel(c_script_8.sumpt)  # disabled

# ---- group: Changing the value for x in a function
panel_18 = Panel("19")  # disabled
panel_19 = Panel("0")  # disabled
c_script_9 = CSharpScript(x=panel_18, y=panel_19, z=panel_19)  # -> out, Point; inputs x: Double, y: Double, z: Double; disabled
# ---------- c_script_9: C# ----------
    Point3d pt = new Point3d (x, y, z);
    Print("Before the Change.X = " + pt.X);

    ChangeX(pt);

    Print("After the Change.X = " + pt.X);
    Point = pt;
# ---------- c_script_9: C# additional code ----------
  public void ChangeX (Point3d pt){
    pt.X = 100;
    Print("Inside the Change.X =" + pt);
  }
# ---------- end c_script_9 ----------
panel_20 = Panel(c_script_9.out)  # disabled
panel_21 = Panel(c_script_9.Point)  # disabled

# ---- group: Creating vectors and points
c_script_10 = CSharpScript()  # -> out, Point0, Point1, Vector0, Vector1, Dot, subVectors, adVectors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; disabled
# ---------- c_script_10: C# ----------
    Point3d p0 = new Point3d (3, 6, 0);
    Vector3d v0 = new Vector3d (4, 1.5, 0);
    double factor = 0.5;

    Point3d p1 = new Point3d(Point3d.Unset);
    p1 = p0 + v0;

    double distance = p0.DistanceTo(p1);

    Vector3d v1 = new Vector3d (Vector3d.Unset);
    v1 = Point3d.Origin - p0;

    Vector3d addVectors = new Vector3d (Vector3d.Unset);
    addVectors = v0 + v1;

    Vector3d subtractVectors = v0 - v1;

    double dot = v0 * v1;

    Vector3d cross = new Vector3d(Vector3d.Unset);
    cross = Vector3d.CrossProduct(v0, v1);

    Vector3d scalev0 = new Vector3d(Vector3d.Unset);
    scalev0 = v0 * factor;

    double v0Length = v0.Length;

    v0 = new Vector3d(10, 0, 0);
    v1 = new Vector3d(0, 10, 0);

    v0.Unitize();
    v1.Unitize();
    dot = v0 * v1;

    if((dot < -1.0))
      dot = -1.0;
    if((dot > 1.0))
      dot = 1.0;
    double angle = System.Math.Acos(dot);

    Point0 = p0;
    Point1 = p1;
    Vector0 = v0;
    Vector1 = v1;
    Dot = dot;
    subVectors = subtractVectors;
    adVectors = addVectors;
    Cross = cross;
    Scale = scalev0;
    Angle = angle;
# ---------- end c_script_10 ----------
point_4 = Point(c_script_10.Point0)  # disabled
panel_22 = Panel(c_script_10.Dot)  # disabled
vector_display = VectorDisplay(Anchor=point_4, Vector=c_script_10.Vector0)  # disabled
panel_23 = Panel("p0")  # disabled
text_tag = TextTag(Location=point_4, Text=panel_23)  # disabled
vector_display_2 = VectorDisplay(Anchor=point_4, Vector=c_script_10.adVectors)  # disabled
vector_display_3 = VectorDisplay(Anchor=point_4, Vector=c_script_10.Vector1)  # disabled
panel_24 = Panel("p1")  # disabled
vector_display_4 = VectorDisplay(Anchor=point_4, Vector=c_script_10.Scale)  # disabled
text_tag_2 = TextTag(Location=c_script_10.Point1, Text=panel_24)  # disabled
vector_display_5 = VectorDisplay(Anchor=point_4, Vector=c_script_10.Cross)  # disabled
panel_25 = Panel("0,0,0")  # disabled
vector_display_6 = VectorDisplay(Anchor=panel_25, Vector=c_script_10.subVectors)  # disabled

# ---- group: Creating geometries in Rhino
c_script_11 = CSharpScript()  # -> out, Line, Polyline, Arc, Circle, Ellipse; disabled
# ---------- c_script_11: C# ----------
    Point3d p0 = new Point3d (0, 0, 0);
    Point3d p1 = new Point3d (5, 1, 0);
    Point3d p2 = new Point3d (6, -3, 0);

    Rhino.Geometry.Line line = new Line (p0, p1);
    Line = line;

    List < Point3d > pts = new List <Point3d> (){p0,p1,p2};
    /*pts.Add(p0);
    pts.Add(p1);
    pts.Add(p2);*/

    Rhino.Geometry.Polyline polyline = new Polyline(pts);
    Polyline = polyline;

    Rhino.Geometry.Circle circle = new Circle(p1, 2);
    Circle = circle;

    Rhino.Geometry.Arc arc = new Arc(circle, 0.234);
    Arc = arc;

    Rhino.Geometry.Ellipse ellipse = new Ellipse(p0, p1, p2);
    Ellipse = ellipse;
# ---------- end c_script_11 ----------
line = Line(c_script_11.Line)  # disabled
curve = Curve(c_script_11.Polyline)  # disabled
curve_2 = Curve(c_script_11.Circle)  # disabled
curve_3 = Curve(c_script_11.Ellipse)  # disabled
curve_4 = Curve(c_script_11.Arc)  # disabled

# ---- group: Create a list of turning ellipses
c_script_12 = CSharpScript()  # -> out, Ellipse; disabled
# ---------- c_script_12: C# ----------
    double angle = 0.01;
    int ellipseCount = 20;
    double x = 1.5;

    List<Ellipse> ellipseList = new List <Ellipse> ();

    Plane plane = Plane.WorldXY;

    for(int i = 1; i <= ellipseCount; i++)
    {
      Point3d pt = new Point3d (x, 0, 0);
      Vector3d y = new Vector3d (0, 1, 0);
      plane.Rotate(angle * i, y, pt);

      Ellipse ellipse = new Ellipse (plane, (double) i / 2, i);

      ellipseList.Add(ellipse);
    }

    Ellipse = ellipseList;
# ---------- end c_script_12 ----------
geometry = Geometry(c_script_12.Ellipse)  # disabled

# ----
panel_26 = Panel(c_script_10.Angle)  # disabled
degrees = Degrees(Radians=panel_26)  # disabled
panel_27 = Panel(degrees)  # disabled

# ---- group: Creating 3D Objects
c_script_13 = CSharpScript()  # -> out, Sphere, Cylinder, Cone, Torus; disabled
# ---------- c_script_13: C# ----------
    Rhino.Geometry.Sphere sphere = new Sphere(new Point3d (2, 4, 0), 3);
    Sphere = sphere;

    Rhino.Geometry.Circle circle = new Circle(2);
    Rhino.Geometry.Cylinder cylinder = new Cylinder(circle, 3);
    Cylinder = cylinder;

    Rhino.Geometry.Cone cone = new Cone (Plane.WorldXY, 4, 2);
    Cone = cone;

    Rhino.Geometry.Torus torus = new Torus (Plane.WorldXY, 3, 1);
    Torus = torus;
# ---------- end c_script_13 ----------
geometry_2 = Geometry(c_script_13.Sphere)  # disabled
geometry_3 = Geometry(c_script_13.Cylinder)  # disabled
geometry_4 = Geometry(c_script_13.Cone)  # disabled
geometry_5 = Geometry(c_script_13.Torus)  # disabled

# ---- group: Create a Geometry Composition
point_5 = Point(Point(-14, 0, 3))  # disabled
point_6 = Point(Point(0, 8, 0))  # disabled
point_7 = Point(Point(-14, 0, 0))  # disabled
point_8 = Point(Point(14, 0, 0))  # disabled
c_script_14 = CSharpScript(pt1=point_8, pt2=point_6, pt3=point_7, pt4=point_5)  # -> out, Arc, Cylinder, Sphere, Lines; inputs pt1: Point3d, pt2: Point3d, pt3: Point3d, pt4: Point3d; disabled
# ---------- c_script_14: C# ----------
    Point3d pt1moved = new Point3d(pt1);
    pt1moved.Transform(Transform.Translation(0, 0, 8));

    Point3d pt3moved = new Point3d(pt3);
    pt3moved.Transform(Transform.Translation(0, 0, 6));

    Rhino.Geometry.Arc arc = new Arc (pt1, pt2, pt3);
    Arc = arc;

    Rhino.Geometry.Circle circle = new Circle (pt1, 2);
    Rhino.Geometry.Cylinder cylinder = new Cylinder (circle, 8);
    Cylinder = cylinder;

    Rhino.Geometry.Sphere sphere = new Sphere(pt4, 1);
    Sphere = sphere;

    Rhino.Geometry.Line line1 = new Line (pt1, pt1moved);
    Rhino.Geometry.Line line2 = new Line (pt3, pt3moved);

    List <Line> lines = new List <Line> () {line1, line2};
    Lines = lines;
# ---------- end c_script_14 ----------
geometry_6 = Geometry(c_script_14.Arc)  # disabled
geometry_7 = Geometry(c_script_14.Sphere)  # disabled
geometry_8 = Geometry(c_script_14.Cylinder)  # disabled
geometry_9 = Geometry(c_script_14.Lines)  # disabled
merge = Merge(Data1=geometry_6, Data2=geometry_8, Data3=geometry_7, Data4=geometry_9)  # disabled

# ---- group: Creating a random radius
c_script_15 = CSharpScript()  # -> out, Circle; disabled
# ---------- c_script_15: C# ----------
    Point3d pt1 = new Point3d (2, 1, 0);
    Random rand = new Random ();
    double radius = rand.Next(10, 20);

    Circle circle = new Circle(Plane.WorldXY, pt1, radius);

    Circle = circle;
# ---------- end c_script_15 ----------
curve_5 = Curve(c_script_15.Circle)  # disabled

# ---- group: Substituting the point as the origin
c_script_16 = CSharpScript()  # -> out, Arc, Circle, Lines; disabled
# ---------- c_script_16: C# ----------
    Random rnd = new Random ();
    double radius = rnd.Next(10, 20);

    Point3d point = new Point3d (2, 1, 0);

    Plane plane = Plane.WorldXY;
    plane.Origin = point;

    Circle circle = new Circle (plane, radius);
    Circle = circle;

    //This is like bounds in Rhino components (Interval)
    Interval angle = new Interval(0, Math.PI);

    Arc arc = new Arc (circle, angle);

    Arc = arc;

    Point3d pt1arc = arc.EndPoint;
    Point3d pt2arc = arc.StartPoint;

    Point3d pt1moved = new Point3d (pt1arc);
    pt1moved.Transform(Transform.Translation(0, 0, 10));


    Point3d pt2moved = new Point3d (pt2arc);
    pt2arc.Transform(Transform.Translation(0, 0, 10));

    Line line1 = new Line (pt1arc, pt1moved);
    Line line2 = new Line (pt2arc, pt2moved);

    List <Line> lines = new List <Line> () {line1, line2};

    Lines = lines;
# ---------- end c_script_16 ----------
curve_6 = Curve(c_script_16.Circle)  # disabled
curve_7 = Curve(c_script_16.Arc)  # disabled
curve_8 = Curve(c_script_16.Lines)  # disabled
merge_2 = Merge(Data1=curve_7, Data2=curve_6, Data3=curve_8)  # disabled

# ---- group: Using vector method
c_script_17 = CSharpScript()  # -> out, Arc, Circle, Lines; disabled
# ---------- c_script_17: C# ----------
    Random rnd = new Random ();
    double radius = rnd.Next(10, 20);

    Point3d point = new Point3d (2, 1, 0);

    Plane plane = Plane.WorldXY;
    plane.Origin = point;

    Circle circle = new Circle (plane, radius);
    Circle = circle;

    //This is like bounds in Rhino components (Interval)
    Interval angle = new Interval(0, Math.PI);

    Arc arc = new Arc (circle, angle);

    Arc = arc;

    Point3d endPoint = arc.EndPoint;
    Point3d startPoint = arc.StartPoint;

    Vector3d vec = Vector3d.ZAxis;
    vec = vec * 10;
    
    Line line1 = new Line (startPoint, vec);
    Line line2 = new Line (endPoint, vec);

    List <Line> lines = new List <Line> () {line1, line2};

    Lines = lines;
# ---------- end c_script_17 ----------
curve_9 = Curve(c_script_17.Circle)  # disabled
curve_10 = Curve(c_script_17.Arc)  # disabled
curve_11 = Curve(c_script_17.Lines)  # disabled
merge_3 = Merge(Data1=curve_10, Data2=curve_9, Data3=curve_11)  # disabled

# ---- group: Different ways to copy data between objects
curve_12 = Curve(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)  # disabled
point_9 = Point(Point(6, -4, 0))  # disabled
c_script_18 = CSharpScript(pt=point_9, crv=curve_12)  # -> out, newCrv; inputs pt: Point3d, crv: Curve; disabled
# ---------- c_script_18: C# ----------
    //Different ways ti copy data between objects
    //Use the constructor when you instantiate an instance of the Point3d class
    Point3d newPt1 = new Point3d(pt);
    Print("new pt1 = " + newPt1.ToString());
    
    //Use the "= Operator" if the class provides one
    Point3d newPt2 = new Point3d(Point3d.Unset);
    newPt2 = pt;
    Print("new pt2 = " + newPt2.ToString());
    
    //Copy the properties one by one
    Point3d newPt3 = new Point3d (Point3d.Unset);
    newPt3.X = pt.X;
    newPt3.Y = pt.Y;
    newPt3.Z = pt.Z;
    Print("new pt3 = " + newPt3.ToString());
    
    //Some geometry classes provide "Duplicate" method that is very efficient to use
    newCrv = crv.DuplicateCurve();
# ---------- end c_script_18 ----------
panel_28 = Panel(c_script_18.out)  # disabled
panel_29 = Panel(c_script_18.newCrv)  # disabled

# ---- group: New method to create a poyline
point_10 = Point([Point(0, 6, 0), Point(5, 5, 0), Point(1, -2, 0), Point(16, 9, 0)])  # disabled
c_script_19 = CSharpScript(pts=point_10)  # -> out, Crv, Type; inputs pts: list of Point3d; disabled
# ---------- c_script_19: C# ----------
    var crv = new Rhino.Geometry.Polyline(pts);

    Crv = crv;
    Type = crv.GetType();
# ---------- end c_script_19 ----------
panel_30 = Panel(c_script_19.Type)  # disabled
curve_13 = Curve(c_script_19.Crv)  # disabled

# ---- group: Get and Set Point3d variables
panel_31 = Panel("3.14")  # disabled
c_script_20 = CSharpScript(x=panel_31)  # -> out, A; inputs x: Double; disabled
# ---------- c_script_20: C# ----------
    Point3d pt = new Point3d(0, 0, 0);
    Print("X = " + pt.X);
    pt.X = x;
    Print("X = " + pt.X);
    A = pt.X;
# ---------- end c_script_20 ----------
panel_32 = Panel(c_script_20.A)  # disabled
panel_33 = Panel(c_script_20.out)  # disabled

# ---- group: Create Interpolated and Control Point Curves
degree = Slider(3, range=0..10)  # disabled
point_11 = Point([Point(1, 0, 0), Point(6, 8, 0), Point(13, 0, 0), Point(20, 8, 0), Point(26, 0, 0)])  # disabled
c_script_21 = CSharpScript(points=point_11, degree=degree)  # -> out, InterpolateCrv, NurbsCrv; inputs points: list of Point3d, degree: Int32; disabled
# ---------- c_script_21: C# ----------
    //declare a curve variable
    Rhino.Geometry.Curve inter_crv = default(Rhino.Geometry.Curve);
    //Create new instance of a curve from interpolate points
    inter_crv = Rhino.Geometry.Curve.CreateInterpolatedCurve(points, degree);

    //Declare a curve variable
    Rhino.Geometry.Curve nurbs_crv = default(Rhino.Geometry.Curve);
    //Create new instance of a curve from control points
    nurbs_crv = Rhino.Geometry.Curve.CreateControlPointCurve(points, degree);

    InterpolateCrv = inter_crv;
    NurbsCrv = nurbs_crv;
# ---------- end c_script_21 ----------

# ---- group: Create an offset curve
curve_14 = Curve(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)  # disabled
c_script_22 = CSharpScript(x=curve_14)  # -> out, A; inputs x: Curve; disabled
# ---------- c_script_22: C# ----------
    Curve[] offsetCurve = x.Offset(Plane.WorldXY, 1.4, 0.01, CurveOffsetCornerStyle.None);
    A = offsetCurve;
# ---------- end c_script_22 ----------
curve_15 = Curve(c_script_22.A)  # disabled

# ---- group: Creating Line using var
point_12 = Point(Point(15, 10, 0))  # disabled
point_13 = Point(Point(0, 0, 0))  # disabled
c_script_23 = CSharpScript(p0=point_13, p1=point_12)  # -> out, Line; inputs p0: Point3d, p1: Point3d; disabled
# ---------- c_script_23: C# ----------
    var lineCurve = new LineCurve(p0, p1);
    Print(lineCurve.ToString());
    Line = lineCurve;
# ---------- end c_script_23 ----------
geometry_10 = Geometry(c_script_23.Line)  # disabled

# ---- group: An array of tween curves
number_slider_10 = Slider(3, range=1..10)  # disabled
curve_16 = Curve(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)  # disabled
curve_17 = Curve(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)  # disabled
c_script_24 = CSharpScript(curve0=curve_17, curve1=curve_16, count=number_slider_10)  # -> out, TweenCurves; inputs curve0: Curve, curve1: Curve, count: Int32; disabled
# ---------- c_script_24: C# ----------
    Curve [] tweenCurves = null;
    tweenCurves = Rhino.Geometry.Curve.CreateTweenCurves(curve0, curve1, count, 0.01);
    TweenCurves = tweenCurves;
# ---------- end c_script_24 ----------
curve_18 = Curve(c_script_24.TweenCurves)  # disabled

# ---- group: Nurbs curve that can change into a Polyline
number_slider_11 = Slider(1, range=1..10)  # disabled
point_14 = Point([Point(26, 4, 0), Point(34, 8, 0), Point(39, 4, 0), Point(40, -3, 0), Point(49, -1, 0), Point(48, 7, 0), Point(44, 9, 0)])  # disabled
c_script_25 = CSharpScript(points=point_14, degree=number_slider_11)  # -> out, A; inputs points: list of Point3d, degree: Int32; disabled
# ---------- c_script_25: C# ----------
    Curve nc = Rhino.Geometry.Curve.CreateControlPointCurve(points, degree);
    A = nc;
# ---------- end c_script_25 ----------
curve_19 = Curve(c_script_25.A)  # disabled

# ---- group: Creating different types of curves
c_script_26 = CSharpScript()  # -> out, Line, Arc, Polyline, PeriodicCurves, OpenCurve; disabled
# ---------- c_script_26: C# ----------
    Point3d p0 = new Point3d (0, 0, 0);
    Point3d p1 = new Point3d (5, 1, 0);
    Point3d p2 = new Point3d (6, -3, 0);

    //Creating a line
    LineCurve line = new LineCurve (p0, p1);

    //Creating an arc
    Arc arc = new Arc (p0, p1, p2);
    ArcCurve arcCurve = new ArcCurve (arc);

    //Creating a polyline
    Point3d [] pointList = {p0,p1,p2};
    PolylineCurve polyline = new PolylineCurve (pointList);

    //Creating one open and one closed curves
    bool isPeriodic = false;
    int degree = 2;
    NurbsCurve openCurve = NurbsCurve.Create(isPeriodic, degree, pointList);
    isPeriodic = true;
    NurbsCurve periodicCurve = NurbsCurve.Create(isPeriodic, degree, pointList);

    Line = line;
    Arc = arc;
    Polyline = polyline;
    PeriodicCurves = periodicCurve;
    OpenCurve = openCurve;
# ---------- end c_script_26 ----------
curve_20 = Curve(c_script_26.Line)  # disabled
curve_21 = Curve(c_script_26.OpenCurve)  # disabled
curve_22 = Curve(c_script_26.Arc)  # disabled
curve_23 = Curve(c_script_26.PeriodicCurves)  # disabled
curve_24 = Curve(c_script_26.Polyline)  # disabled

# ---- group: Divide Surface by Curve, UV
number_slider_12 = Slider(8.1, range=0.1..8.1)  # disabled
surface = Surface(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)  # disabled
c_script_27 = CSharpScript(srf=surface, p=number_slider_12)  # -> out, IsoCurve; inputs srf: Surface, p: Double; disabled
# ---------- c_script_27: C# ----------
    var isoCurve = srf.IsoCurve(0, p);
    IsoCurve = isoCurve;
# ---------- end c_script_27 ----------
curve_25 = Curve(c_script_27.IsoCurve)  # disabled

# ---- group: Multiple offset of a curve
number_slider_13 = Slider(5, range=1..10)  # disabled
xy_plane = XYPlane(Origin=Point(0, 0, 0))  # disabled
panel_34 = Panel("-1.2")  # disabled
panel_35 = Panel("0.01")  # disabled
curve_26 = Curve(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)  # disabled
c_script_28 = CSharpScript(crv=curve_26, num=number_slider_13, dis=panel_34, tol=panel_35, plane=xy_plane)  # -> out, A; inputs crv: Curve, num: Int32, dis: Double, tol: Double, plane: Plane; disabled
# ---------- c_script_28: C# ----------
    //Declare the list of curves
    List <Curve> crvs = new List <Curve> ();
    Curve lastCurve = crv;
    for (int i = 1; i <= num; i++)
    {
      Curve [] curveArray = lastCurve.Offset(plane, dis, tol, CurveOffsetCornerStyle.None);

      //Ignore if the output
      if (crv.IsValid && curveArray.GetLength(0) == 1)
      {
        //Appen the offset curve to an array
        crvs.Add(curveArray[0]);

        //Update the next curve to offset
        lastCurve = curveArray[0];
      }
      else {
        break;
      }
    }

    A = crvs;
# ---------- end c_script_28 ----------
curve_27 = Curve(c_script_28.A)  # disabled

# ---- group: Creating a fillet surface in bertween 2 other surfaces
number_slider_14 = Slider(3.6, range=0.1..10)  # disabled
surface_2 = Surface(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)  # disabled
panel_36 = Panel("0.01")  # disabled
surface_3 = Surface(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)  # disabled
c_script_29 = CSharpScript(srfA=surface_3, srfB=surface_2, radius=number_slider_14, tol=panel_36)  # -> out, A; inputs srfA: Surface, srfB: Surface, radius: Double, tol: Double; disabled
# ---------- c_script_29: C# ----------
    //Declare an array of surfaces
    Surface[] surfaces = {};

    //Check for a valid input
    if (srfA != null && srfB != null)
    {
      //Create fillet surfaces
      surfaces = Surface.CreateRollingBallFillet(srfA, srfB, radius, tol);
    }

    A = surfaces;
# ---------- end c_script_29 ----------
geometry_11 = Geometry(c_script_29.A)  # disabled

# ---- group: Outputting ControlPoints from a NurbsCurve
curve_28 = Curve(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)  # disabled
c_script_30 = CSharpScript(crv=curve_28)  # -> out, PointsCrv; inputs crv: Curve; disabled
# ---------- c_script_30: C# ----------
    //Get the domain or interval of the curve
    Interval domain = crv.Domain;

    //Get the start and the end points of a curve
    Point3d startPoint = crv.PointAtStart;
    Point3d endPoint = crv.PointAtEnd;

    //Ge the tangent at start of the curve
    Vector3d starTangent = crv.TangentAtStart;

    //Get the control points of a NurbsCurve (nc)
    NurbsCurve nc = crv.ToNurbsCurve();

    List <Point3d> cpList = new List <Point3d> ();
    int count = nc.Points.Count;

    //Loop tp get all cv points
    for (int i = 0; i <= count - 1; i++){
      ControlPoint cp = nc.Points[i];
      cpList.Add(cp.Location);
    }

    //Get the knot list of a NurbsCurve (nc)
    List <double> knotList = new List <double> ();

    //Loop to get all knots values
    for (int i = 0; i <= count - 1; i++){
      double knot = nc.Knots[i];
      knotList.Add(knot);
    }

    /*Divide curve (crv) by number (num)
    Declare an array of point */
    int num = 4;
    Point3d[] points = {};

    //Divide the curve by number
    crv.DivideByCount(num, true, out points);

    PointsCrv = cpList;
# ---------- end c_script_30 ----------
point_15 = Point(c_script_30.PointsCrv)  # disabled

# ---- group: REVIEW!
number_slider_15 = Slider(3.6, range=0.1..10)  # disabled
surface_4 = Surface(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)  # disabled
panel_37 = Panel("0.01")  # disabled
surface_5 = Surface(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)  # disabled
c_script_31 = CSharpScript(srfA=surface_5, srfB=surface_4, radius=number_slider_15, tol=panel_37)  # -> out, A; inputs srfA: Surface, srfB: Surface, radius: Double, tol: Double; disabled
# ---------- c_script_31: C# ----------
    Surface [] surfaces = null;

    if (srfA != null && srfB != null)
    {
      surfaces = Surface.CreateRollingBallFillet(srfA, srfB, radius, tol);
    }

    A = surfaces;
# ---------- end c_script_31 ----------
geometry_12 = Geometry(c_script_31.A)  # disabled

# ---- group: Create a RevSurface from a line and a profile curve
curve_29 = Curve(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)  # disabled
line_2 = Line(Line((0, 12, 33), (0, 12, -3)))  # disabled
c_script_32 = CSharpScript(revCurve=curve_29, revAxis=line_2)  # -> out, PlaneSrf, RevSrf; inputs revCurve: Curve, revAxis: Line; disabled
# ---------- c_script_32: C# ----------
    int x0 = -10;
    int x1 = 10;

    int y0 = -5;
    int y1 = 5;

    var plane = Plane.WorldXY;
    var xExtents = new Interval(x0, x1);
    var yExtents = new Interval(y0, y1);

    var planeSurface = new PlaneSurface(plane, xExtents, yExtents);

    var revSrf = RevSurface.Create(revCurve, revAxis);
    
    PlaneSrf = planeSurface;
    RevSrf = revSrf;
# ---------- end c_script_32 ----------
geometry_13 = Geometry(c_script_32.RevSrf)  # disabled

# ---- group: Drawing NurbsSurface
point_16 = Point([Point(20, 0, 0), Point(40, 0, 0), Point(28, 5, 6), Point(31, -5, 6)])  # disabled
c_script_33 = CSharpScript(Pts=point_16)  # -> out, A; inputs Pts: list of Point3d; disabled
# ---------- c_script_33: C# ----------
    NurbsSurface ns = null;
    ns = NurbsSurface.CreateThroughPoints(Pts, 2, 2, 1, 1, false, false);
    A = ns;
# ---------- end c_script_33 ----------

# ---- group: Creating surface from curve and vector
curve_30 = Curve(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)  # disabled
vector = Vector(Vector(0, 0, 10))  # disabled
c_script_34 = CSharpScript(crv=curve_30, vector=vector)  # -> out, A; inputs crv: Curve, vector: Vector3d; disabled
# ---------- c_script_34: C# ----------
    //Create a nurbs surface from extruding a curve in some direction (vector)
    var nSrf = NurbsSurface.CreateExtrusion(crv, vector);
    //Create an extrusion from extruding a curve in some direction (vector)
    var ex = Extrusion.Create(crv, -10, false);

    Rhino.RhinoDoc.ActiveDoc.Objects.AddExtrusion(ex);
    
    A = ex;
# ---------- end c_script_34 ----------

# ---- group: Creating
geometry_14 = Geometry(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)  # disabled
c_script_35 = CSharpScript(srf=geometry_14)  # -> out, IsPlanar, EvalPt, TanU, TanV; inputs srf: Surface; disabled
# ---------- c_script_35: C# ----------
    //Check if the input surface is closed in the u or v direction
    bool isClosedU = srf.IsClosed(0);
    bool isClosedV = srf.IsClosed(1);

    //Check if the surface is planar at zero tolerance
    bool isPlanar = srf.IsPlanar();

    double u = 0.5;
    double v = 0.5;
    //Declare and instantiate the evaluation point and derivative vectors
    Point3d evalPt = new Point3d(Point3d.Unset);
    Vector3d[] derivatives = {};

    //Evaluate the surface and extract the first derivative to get tangents
    srf.Evaluate(u, v, 1, out evalPt, out derivatives);

    Vector3d tanU = derivatives[0];
    Vector3d tanV = derivatives[1];

    IsPlanar = isPlanar;
    EvalPt = evalPt;
    TanU = tanU;
    TanV = tanV;
# ---------- end c_script_35 ----------
panel_38 = Panel(c_script_35.IsPlanar)  # disabled
vector_2 = Vector(c_script_35.TanU)  # disabled
point_17 = Point(c_script_35.EvalPt)  # disabled
vector_3 = Vector(c_script_35.TanV)  # disabled
vector_display_7 = VectorDisplay(Anchor=point_17, Vector=vector_2)  # disabled
vector_display_8 = VectorDisplay(Anchor=point_17, Vector=vector_3)  # disabled

# ---- group: Creating offsetting surfaces
number_slider_16 = Slider(3, range=1..10)  # disabled
panel_39 = Panel("0.001")  # disabled
geometry_15 = Geometry(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)  # disabled
panel_40 = Panel("2")  # disabled
c_script_36 = CSharpScript(srf=geometry_15, num=number_slider_16, dis=panel_40, tol=panel_39)  # -> out, Srfs; inputs srf: Surface, num: Int32, dis: Int32, tol: Double; disabled
# ---------- c_script_36: C# ----------
    List <Surface> srfs = new List <Surface> ();

    Surface lastSrf = srf;
    for (int i = 1; i <= num; i++)
    {
      Surface offset_srf = lastSrf.Offset(dis, tol);
      if (srf.IsValid)
      {
        //append offset surface to array
        srfs.Add(offset_srf);
        //update the next curve offset
        lastSrf = offset_srf;
      }
      else
        break;
    }

    Srfs = srfs;
# ---------- end c_script_36 ----------
geometry_16 = Geometry(c_script_36.Srfs)  # disabled

# ---- group: Creating a cone from curve
c_script_37 = CSharpScript()  # -> out, A, B; disabled
# ---------- c_script_37: C# ----------
    Line axis = new Line (Point3d.Origin, new Point3d (0, 0, 10));
    LineCurve crv = new LineCurve(new Point3d (2, 0, 0), new
      Point3d (3.5, 0, 5));

    //Create surface of revolution
    RevSurface revSrf = RevSurface.Create(crv, axis);

    //Try to get a Cone
    Cone cone;
    if(revSrf.TryGetCone(out cone))
      Print("The cone was successfully created from surface");

    A = cone;
    B = revSrf;
# ---------- end c_script_37 ----------
geometry_17 = Geometry(c_script_37.B)  # disabled
geometry_18 = Geometry(c_script_37.A)  # disabled
panel_41 = Panel(c_script_37.out)  # disabled

# ---- group: Create Mesh from Brep
brep = Brep(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)  # disabled
c_script_38 = CSharpScript(brep=brep)  # -> out, BrepMesh; inputs brep: Brep; disabled
# ---------- c_script_38: C# ----------
    //Set the mesh parameters to default
    var mp = MeshingParameters.QualityRenderMesh;

    //Create meshes from brep
    var newMesh = Mesh.CreateFromBrep(brep, mp);

    BrepMesh = newMesh;
# ---------- end c_script_38 ----------
mesh = Mesh(c_script_38.BrepMesh)  # disabled

# ---- group: Create the curve outline of a mesh
mesh_2 = Mesh(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)  # disabled
c_script_39 = CSharpScript(mesh=mesh_2)  # -> out, A; inputs mesh: Mesh; disabled
# ---------- c_script_39: C# ----------
    //Get the meshes' topology
    Rhino.Geometry.Collections.MeshTopologyEdgeList meshEdges = mesh.TopologyEdges;

    List <Line> lines = new List <Line>();

    //Find all of the mesh edges that have only a single mesh face
    for (int i = 0; i <= meshEdges.Count - 1; i++)
    {
      int numOfFaces = meshEdges.GetConnectedFaces(i).Length;

      if ((numOfFaces == 1))
      {
        Line line = meshEdges.EdgeLine(i);
        lines.Add(line);
      }
    }
    A = lines;
# ---------- end c_script_39 ----------
curve_31 = Curve(c_script_39.A)  # disabled

# ---- group: Creating a simple rectangular mesh with 1 face
# Release me - song!
# Meshes
c_script_40 = CSharpScript()  # -> out, Mesh, Normal; disabled
# ---------- c_script_40: C# ----------
                        /* Create a simple rectangular mesh that has 1 face
      Creating a new instance of a mesh*/
    Rhino.Geometry.Mesh mesh = new Rhino.Geometry.Mesh();

    //Add mesh vertices
    mesh.Vertices.Add(0.0, 0.0, 0.0); //0
    mesh.Vertices.Add(5.0, 0.0, 0.0); //1
    mesh.Vertices.Add(5.0, 5.0, 0.0); //2
    mesh.Vertices.Add(0.0, 5.0, 0.0); //3

    //Add mesh faces
    mesh.Faces.AddFace(0, 1, 2, 3);

    //Compute mesh normals
    Normal = mesh.Normals.ComputeNormals();

    //Generate any additional mesh data
    mesh.Compact();

    //RElease m - song

    Mesh = mesh;
# ---------- end c_script_40 ----------
mesh_3 = Mesh(c_script_40.Mesh)  # disabled
panel_42 = Panel(c_script_40.Normal)  # disabled

# ---- group: Creating a triangular mesh with 2 faces
c_script_41 = CSharpScript()  # -> out, Mesh; disabled
# ---------- c_script_41: C# ----------
    /*Create a simple triangle mesh that has 2 faces
      Creating a new instance of a mesh:*/
    Rhino.Geometry.Mesh mesh = new Rhino.Geometry.Mesh();
    
    //Add the mesh vertices
    mesh.Vertices.Add(0.0, 0.0, 0.0); //0
    mesh.Vertices.Add(5.0, 0.0, 2.0); //1
    mesh.Vertices.Add(5.0, 5.0, 0.0); //2
    mesh.Vertices.Add(0.0, 5.0, 2.0); //3
    
    //Add mesh faces
    mesh.Faces.AddFace(0, 1, 2);
    mesh.Faces.AddFace(0, 2, 3);
    
    //Compute the mesh normals
    mesh.Normals.ComputeNormals();
    
    //Generate any additional mesh data
    mesh.Compact();
    
    Mesh = mesh;
# ---------- end c_script_41 ----------
mesh_4 = Mesh(c_script_41.Mesh)  # disabled

# ---- group: Create mesh from Polyline
curve_32 = Curve(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)  # disabled
c_script_42 = CSharpScript(pline=curve_32)  # -> out, PolylineMesh; inputs pline: Polyline; disabled
# ---------- c_script_42: C# ----------
    //Create a new mesh from a polyline
    var newMesh = Mesh.CreateFromClosedPolyline(pline);

    PolylineMesh = newMesh;
# ---------- end c_script_42 ----------
mesh_5 = Mesh(c_script_42.PolylineMesh)  # disabled

# ---- group: Deleting mesh faces randomly
mesh_6 = Mesh(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)  # disabled
c_script_43 = CSharpScript(mesh=mesh_6)  # -> out, A; inputs mesh: Mesh; disabled
# ---------- c_script_43: C# ----------
    int index = 16;
    //Remove a mesh vertex (make sure index falls within range)
    if (index >= 0 & index < mesh.Vertices.Count)
    {
      mesh.Vertices.Remove(index, true);
    }
    A = mesh;
# ---------- end c_script_43 ----------
mesh_7 = Mesh(c_script_43.A)  # disabled

# ---- group: Using the SetVertex method
mesh_8 = Mesh(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)  # disabled
c_script_44 = CSharpScript(mesh=mesh_8)  # -> out, A; inputs mesh: Mesh; disabled
# ---------- c_script_44: C# ----------
    //Create a new instance of a random generator
    Random rand = new Random();
    for (int i = 0; i <= mesh.Vertices.Count - 1; i++)
    {
      //Get vertex
      Point3f loc = mesh.Vertices[i];
      loc.Z = rand.Next(10) / 3;

      //Assign new location
      mesh.Vertices.SetVertex(i, loc);
    }
    
    A = mesh;
# ---------- end c_script_44 ----------
mesh_9 = Mesh(c_script_44.A)  # disabled

# ---- group: Extract the naked edges of a mesh
mesh_10 = Mesh(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)  # disabled
c_script_45 = CSharpScript(mesh=mesh_10)  # -> out, A; inputs mesh: Mesh; disabled
# ---------- c_script_45: C# ----------
    //Declare an array of polylines
    Polyline[] nakedEdges = {};
    
    //Create a new mes from polyline
    nakedEdges = mesh.GetNakedEdges();
    
    A = nakedEdges;
# ---------- end c_script_45 ----------
curve_33 = Curve(c_script_45.A)  # disabled

# ---- group: Check if the point is in the sphere or not
mesh_11 = Mesh(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)  # disabled
point_18 = Point(Point(18, 0, 0))  # disabled
c_script_46 = CSharpScript(mesh=mesh_11, pt=point_18)  # -> out, A; inputs mesh: Mesh, pt: Point3d; disabled
# ---------- c_script_46: C# ----------
    double tolerance = 0.01;

    A = mesh.IsPointInside(pt, tolerance, true);
# ---------- end c_script_46 ----------
panel_43 = Panel(c_script_46.A)  # disabled

# ---- group: Delete every other mesh face then split the disjoint meshes
mesh_12 = Mesh(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)  # disabled
c_script_47 = CSharpScript(mesh=mesh_12)  # -> out, A; inputs mesh: Mesh; disabled
# ---------- c_script_47: C# ----------
    List <int> faceIndeces = new List <int>();

    //Loop through fces and delete every other face
    for (int i = 0; i <= mesh.Faces.Count - 1; i += 2)
    {
      faceIndeces.Add(i);
    }
    //delete faces
    mesh.Faces.DeleteFaces(faceIndeces);
    //Split the disjoint meshes
    Mesh [] meshArray = mesh.SplitDisjointPieces();

    A = meshArray;
# ---------- end c_script_47 ----------
mesh_13 = Mesh(c_script_47.A)  # disabled

# ---- group: Taking the points out of a 2D mesh and then randomizing their Z-Coordinate
mesh_14 = Mesh(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)  # disabled
c_script_48 = CSharpScript(mesh=mesh_14)  # -> out, A; inputs mesh: Mesh; disabled
# ---------- c_script_48: C# ----------
    int index = 0;
    Random rand = new Random();

    foreach (Point3f loc in mesh.Vertices)
    {
      Point3f newLoc = loc;
      newLoc.Z = rand.Next(10) / 3;
      mesh.Vertices[index] = newLoc;
      index = index + 1;
    }
    
    A = mesh;
# ---------- end c_script_48 ----------
mesh_15 = Mesh(c_script_48.A)  # disabled

# ---- group: Delete mesh faces randomly
mesh_16 = Mesh(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)  # disabled
c_script_49 = CSharpScript(mesh=mesh_16)  # -> out, A; inputs mesh: Mesh; disabled
# ---------- c_script_49: C# usings ----------
using System.Linq;
# ---------- c_script_49: C# ----------
    List <int> faceIndices = new List <int> ();
    int count = mesh.Faces.Count;

    //Create a new instance of a random generator
    Random rand = new Random ();

    for (int i = 0; i <= count; i += 2)
    {
      int index = rand.Next(count);
      faceIndices.Add(index);
    }

    //delete the duplicate indexes
    List <int> distinctIndices = faceIndices.Distinct().ToList();

    //delete the faces
    mesh.Faces.DeleteFaces(distinctIndices);

    A = mesh;
# ---------- end c_script_49 ----------
mesh_17 = Mesh(c_script_49.A)  # disabled

# ---- group: Create a Brep from bounding edge curves
curve_34 = Curve([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])  # disabled
c_script_50 = CSharpScript(crvs=curve_34)  # -> out, A; inputs crvs: list of Curve; disabled
# ---------- c_script_50: C# ----------
    //Build the brep from edges
    Brep edgeBrep = Brep.CreateEdgeSurface(crvs);
    A = edgeBrep;
# ---------- end c_script_50 ----------
geometry_19 = Geometry(c_script_50.A)  # disabled

# ---- group: Check if the brep has merged coplanar faces
geometry_20 = Geometry(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)
c_script_51 = CSharpScript(brep=geometry_20)  # -> out, A, B; inputs brep: Brep
# ---------- c_script_51: C# ----------
    double tol = 0.01;

    bool merged = brep.MergeCoplanarFaces(tol);

    A = merged;
    B = brep;
# ---------- end c_script_51 ----------
geometry_21 = Geometry(c_script_51.B)
panel_44 = Panel(c_script_51.A)

# ---- group: Boolean Union 2 Breps
panel_45 = Panel("0.01")  # disabled
geometry_22 = Geometry([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])  # disabled
c_script_52 = CSharpScript(breps=geometry_22, tol=panel_45)  # -> out, A; inputs breps: list of Brep, tol: Double; disabled
# ---------- c_script_52: C# ----------
    Brep[] unionBrep = Brep.CreateBooleanUnion(breps, tol);
    
    A = unionBrep;
# ---------- end c_script_52 ----------
geometry_23 = Geometry(c_script_52.A)  # disabled

# ---- group: Create a Brep from points
point_19 = Point([Point(0, 10, 0), Point(10, 10, 0), Point(0, 0, 0), Point(10, 0, 0), Point(-3, 5, 6), Point(5, 12, 6), Point(5, -3, 6), Point(12, 5, 6)])  # disabled
c_script_53 = CSharpScript(corners=point_19)  # -> out, A; inputs corners: list of Point3d; disabled
# ---------- c_script_53: C# ----------
    //Create tue brep from corners
    Brep twistedBox = Brep.CreateFromBox(corners);
    A = twistedBox;
# ---------- end c_script_53 ----------
geometry_24 = Geometry(c_script_53.A)  # disabled

# ---- group: Calculating the brep area, volume and centroid
brep_2 = Brep(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)  # disabled
c_script_54 = CSharpScript(brep=brep_2)  # -> out, Area, Volume, Centroid; inputs brep: Brep; disabled
# ---------- c_script_54: C# ----------
    //Create a new instace of mass properties classes
    VolumeMassProperties volumeMp = VolumeMassProperties.Compute(brep);
    AreaMassProperties areaMp = AreaMassProperties.Compute(brep);

    //Calculate the area, volume and centroid
    Area = brep.GetArea(); // another possibility: area = areaMp.Area
    Volume = brep.GetVolume(); // another possibility: volume = volumeMp.Volume
    Centroid = volumeMp.Centroid;
# ---------- end c_script_54 ----------
panel_46 = Panel(c_script_54.Centroid)  # disabled
panel_47 = Panel(c_script_54.Area)  # disabled
panel_48 = Panel(c_script_54.Volume)  # disabled

# ---- group: Navigating the different parts of a Brep topology
brep_3 = Brep(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)  # disabled
c_script_55 = CSharpScript(brep=brep_3)  # -> out, Faces, Loops, Edges, Trims, Vertices; inputs brep: Brep; disabled
# ---------- c_script_55: C# ----------
    //Brep topology (3D modeling space)
    Rhino.Geometry.Collections.BrepFaceList faces = brep.Faces;
    for (int fi = 0; fi < faces.Count; fi++)
    {
      BrepFace face = faces[fi];
      //Get adjacent faces
      var aFaces = face.AdjacentFaces();
      //Get adjacent edges
      var aEdges = face.AdjacentEdges();
      //Get face loops
      var faceLoops = face.Loops;
      //Get the 3D untrimmed surface
      var face3dSurface = face.UnderlyingSurface();
    }

    Faces = faces;

    //BrepLoop topology (2D parameter space)
    Rhino.Geometry.Collections.BrepLoopList loops = brep.Loops;
    for (int li = 0; li < loops.Count; li++)
    {
      BrepLoop loop = loops[li];
      //Get the loop face
      var loopFace = loop.Face;
      //Get the loop trims
      var loopTrims = loop.Trims;
      //Get the loop 2D and 3D curves
      var loop2dCurve = loop.To2dCurve();
      var loop3dCurve = loop.To3dCurve();
    }

    Loops = loops;

    //BrepEdge to topology (3D modeling space)
    Rhino.Geometry.Collections.BrepEdgeList edges = brep.Edges;
    for (int ei = 0; ei < edges.Count; ei++)
    {
      BrepEdge edge = edges[ei];
      //Get the edge faces
      var eFaces_i = edge.AdjacentFaces();
      //Get the edge start and end vertices
      var eStartVertex = edge.StartVertex;
      var eEndVertex = edge.EndVertex;
      //Get the edge trim indices
      var eTrimIndices = edge.TrimIndices();
      //Get the edge 3D curve
      var e3dCurve = edge.EdgeCurve;
    }

    Edges = edges;

    //BrepTrim topology (2D parameter space)
    Rhino.Geometry.Collections.BrepTrimList trims = brep.Trims;
    for(int ti = 0; ti < trims.Count;ti++)
    {
      BrepTrim trim = trims[ti];
      //Get the edge
      var trimEdge = trim.Edge;
      //Get the trim start and end vertices
      var trimStartVertex = trim.StartVertex;
      var trimEndVertex = trim.EndVertex;
      //Get the trim loop
      var trimLoop = trim.Loop;
      //Get the trim face
      var trimFace = trim.Face;
      //Get the trim 2D curve
      var trim2dCurve = trim.TrimCurve;
    }

    Trims = trims;

    //Brep Vertex topology (3D modeling space)
    Rhino.Geometry.Collections.BrepVertexList vertices = brep.Vertices;
    for(int vi = 0; vi < vertices.Count; vi++)
    {
      BrepVertex vertex = vertices[vi];
      //Get vertex edges
      var vEdges = vertex.EdgeIndices();
      //Get vertex location
      var vPoint = vertex.Location;
    }
    
    Vertices = vertices;
# ---------- end c_script_55 ----------
panel_49 = Panel(c_script_55.Trims)  # disabled
# Breps
panel_50 = Panel(c_script_55.Faces)  # disabled
panel_51 = Panel(c_script_55.Vertices)  # disabled
panel_52 = Panel(c_script_55.Edges)  # disabled
panel_53 = Panel(c_script_55.Loops)  # disabled

# ---- group: Create a 2D drawing from a 3D geometry
plane = Plane(Plane(origin=(1, 11, 3), x=(0, 0, -1), y=(1, 0, 0)))  # disabled
geometry_25 = Geometry([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])  # disabled
c_script_56 = CSharpScript(geomList=geometry_25, cplaneList=plane)  # -> out, A; inputs geomList: list of GeometryBase, cplaneList: list of Plane; disabled
# ---------- c_script_56: C# ----------
    //Use the active view in the Rhino document
    var _view = doc.Views.ActiveView;
    //Set the Make2D parameters
    var _hldParams = new HiddenLineDrawingParameters
      {
        AbsoluteTolerance = doc.ModelAbsoluteTolerance,
        IncludeTangentEdges = false,
        IncludeHiddenCurves = true
        };
    _hldParams.SetViewport(_view.ActiveViewport);

    //Add the objects to the hld_param
    foreach(var geom in geomList)
    {
      _hldParams.AddGeometry(geom, Transform.Identity, null);
    }

    //Add the clipping planes
    foreach(var cplane in cplaneList)
    {
      _hldParams.AddClippingPlane(cplane);
    }

    //Perform the HLD calculations
    var visibleList = new List<Curve>();
    var hiddenList = new List<Curve>();
    var secVisibleList = new List<Curve>();
    var secHiddenList = new List<Curve>();
    var _hld = HiddenLineDrawing.Compute(_hldParams, true);

    if(_hld != null)
    {
      //Transform
      var flatten = Transform.PlanarProjection(Plane.WorldXY);
      BoundingBox pageBox = _hld.BoundingBox(true);
      var delta2D = new Vector2d(0, 0);
      delta2D = delta2D - new Vector2d(pageBox.Min.X, pageBox.Min.Y);
      var delta3D = Transform.Translation(new Vector3d(delta2D.X, delta2D.Y, 0.0));
      flatten = delta3D * flatten;

      //add the curves to the list
      foreach(HiddenLineDrawingSegment hldCurve in _hld.Segments)
      {
        if(hldCurve == null ||
          hldCurve.ParentCurve == null ||
          hldCurve.ParentCurve.SilhouetteType == SilhouetteType.None)
          continue;
        var crv = hldCurve.CurveGeometry.DuplicateCurve();
        if(crv != null)
        {
          crv.Transform(flatten);
          if(hldCurve.SegmentVisibility == HiddenLineDrawingSegment.Visibility.Visible)
          {
            if(hldCurve.ParentCurve.SilhouetteType == SilhouetteType.SectionCut)
              secVisibleList.Add(crv);
            else
              visibleList.Add(crv);
          }
          else if(hldCurve.SegmentVisibility == HiddenLineDrawingSegment.Visibility.Hidden)
          {
            if(hldCurve.ParentCurve.SilhouetteType == SilhouetteType.SectionCut)
              secHiddenList.Add(crv);
            else
              hiddenList.Add(crv);
          }
        }
      }
    }
# ---------- end c_script_56 ----------
geometry_26 = Geometry(c_script_56.A)  # disabled

# ---- group: Extracting the outline of a Brep ignoring all the holes
geometry_27 = Geometry(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)
c_script_57 = CSharpScript(brep=geometry_27)  # -> out, Outline; inputs brep: Brep
# ---------- c_script_57: C# ----------
    //Declare outline list of curves
    List <Curve> outline = new List <Curve> ();
    //Check all the loops and the extract naked edges that are not inner
    foreach(BrepLoop eLoop in brep.Loops)
    {
      //Make sure the loop type is outer
      if(eLoop.LoopType == BrepLoopType.Outer)
      {
        //Navigat through the trims of the loop
        foreach(BrepTrim trim in eLoop.Trims)
        {
          //Get the edge of each trim
          BrepEdge edge = trim.Edge;
          //Check if the ege has only one trim
          if(edge.TrimCount == 1)
          {
            //Add a copy of the edge curve to the list
            outline.Add(edge.DuplicateCurve());
          }
        }
      }
    }
    Outline = outline;
# ---------- end c_script_57 ----------
geometry_28 = Geometry(c_script_57.Outline)

# ---- group: Create Breps from bounding surfaces
brep_4 = Brep([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])  # disabled
panel_54 = Panel("0.01")  # disabled
c_script_58 = CSharpScript(breps=brep_4, tol=panel_54)  # -> out, A; inputs breps: list of Brep, tol: Double; disabled
# ---------- c_script_58: C# ----------
    //Build the brep from corners
    Brep[] solids = Brep.CreateSolid(breps, tol);
    A = solids;
# ---------- end c_script_58 ----------
geometry_29 = Geometry(c_script_58.A)  # disabled

# ---- group: Check if a brep is valid and is a solid
brep_5 = Brep([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])  # disabled
c_script_59 = CSharpScript(breps=brep_5)  # -> out, A; inputs breps: list of Brep; disabled
# ---------- c_script_59: C# ----------
    List <bool> isSolid = new List <bool> ();
    foreach(Brep brep in breps)
      if(brep.IsValid)
        isSolid.Add(brep.IsSolid);
    A = isSolid;
# ---------- end c_script_59 ----------
panel_55 = Panel(c_script_59.A)  # disabled

# ---- group: Count the geometry and topology elements of a Brep and then 3D geometry
geometry_30 = Geometry(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)  # disabled
c_script_60 = CSharpScript(brep=geometry_30)  # -> out, Vertices, Curves, Surfaces; inputs brep: Brep; disabled
# ---------- c_script_60: C# ----------
    //Print the number of geometry elements
    Print("brep.Vertices.Count = {0}", brep.Vertices.Count);
    Print("brep.Curves3D.Count = {0}", brep.Curves3D.Count);
    Print("brep.Curves2D.Count = {0}", brep.Curves2D.Count);
    Print("brep.Surfaces.Count = {0}", brep.Surfaces.Count);

    //Print the number of topology elements
    Print("brep.Trims.Count = {0}", brep.Trims.Count);
    Print("brep.Loops.Count = {0}", brep.Loops.Count);
    Print("brep.Faces.Count = {0}", brep.Faces.Count);
    Print("brep.Edges.Count = {0}", brep.Edges.Count);

    //Extract the 3D geometry
    var V = brep.Vertices;
    var C = brep.Curves3D;
    var S = brep.Surfaces;

    Vertices = V;
    Curves = C;
    Surfaces = S;
# ---------- end c_script_60 ----------
point_20 = Point(c_script_60.Vertices)  # disabled
line_3 = Line(c_script_60.Curves)  # disabled
surface_6 = Surface(c_script_60.Surfaces)  # disabled
panel_56 = Panel(c_script_60.out)  # disabled

# ---- group: Extracting the faces of a Brep Box and moving them away from the center
geometry_31 = Geometry(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)  # disabled
c_script_61 = CSharpScript(brep=geometry_31)  # -> out, A; inputs brep: Brep; disabled
# ---------- c_script_61: C# ----------
    //Declare a list of faces
    List <Brep> faces = new List <Brep>();

    //Find the center
    Point3d center = brep.GetBoundingBox(true).Center;
    for (int i = 0; i <= brep.Faces.Count - 1; i++)
    {
      //Extract the faces
      int [] iList = {i};
      Brep face = brep.DuplicateSubBrep(iList);
      //Find the face center
      Point3d faceCenter = face.GetBoundingBox(true).Center;
      //Find the moving direction
      Vector3d dir = new Vector3d();
      dir = faceCenter - center;
      //Move the face and add to list
      face.Translate(dir);
      faces.Add(face);
    }
    A = faces;
# ---------- end c_script_61 ----------
geometry_32 = Geometry(c_script_61.A)  # disabled
