# Grasshopper definition Chapter4.gh (Grasshopper 1.0.7)

# ---- group: Simple subdivision
curve = Curve(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)
surface = Surface(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)
c_script = CSharpScript(srf=surface, inPolylines=curve, degree=Slider(3, range=0..10))  # -> out, OutPolylines, OutMesh; inputs srf: Surface, inPolylines: list of Polyline, degree: Int32
# ---------- c_script: C# ----------
    //Instantiate the collection of all panels
    List<Polyline> outPanels = new List<Polyline>();

    //Limit to 6 subdivisions
    if(degree > 6)
      degree = 6;

    for(int i = 0; i < degree; i++)
    {
      //Outer polylines
      List<Polyline> plines = new List<Polyline>();

      //Mid polylines
      List <Polyline> midPlines = new List<Polyline>();

      //Generate the subdivided panels
      bool result = SubPanelOnSurface(srf, inPolylines.ToArray(), ref plines, ref midPlines);
      if(result == false)
        break;

      //Add outer panels
      outPanels.AddRange(plines);

      //Add mid panels only in the last iteration
      if(i == degree - 1)
        outPanels.AddRange(midPlines);
      else//subdivide mid panels only
        inPolylines = midPlines;
    }

    //Create a mesh from all of the polylines
    Mesh joinedMesh = new Mesh();
    for(int i = 0; i < outPanels.Count; i++)
    {
      Mesh mesh = Mesh.CreateFromClosedPolyline(outPanels[i]);
      joinedMesh.Append(mesh);
    }

    //Make sure that all of the mesh face normals are in the same general direction
    joinedMesh.UnifyNormals();

    //Assign the outputs
    OutPolylines = outPanels;
    OutMesh = joinedMesh;
# ---------- c_script: C# additional code ----------
  bool SubPanelOnSurface(Surface srf, Polyline[] inputPanels, ref List<Polyline> outPanels, ref List<Polyline> midPanels)
  {
    //Check for a valid input
    if(inputPanels.Length == 0 || null == srf)
      return false;
    for(int i = 0; i < inputPanes.Length; i++)
    {
      Polyline ipline = inputPanels[i];
      if(!pline.IsValid || !pline.IsClosed)
        continue;

      //Stack of points
      List<Point3d> stack = new List<Point3d> ();
      Polyline newPline = new Polyline();
      for(int j = 1; j < ipline.Count; j++)
      {
        Line line = new Line(ipline[j - 1], ipline[j]);

        if(line.IsValid)
        {
          Point3d mid = line.PointAt(0.5);
          double s, t;
          srf.ClosestPoint(mid, out s, out t);
          mid = srf.PointAt(s, t);
          newPline.Add(mid);
        }
      }
    }
  }
# ---------- end c_script ----------

# ---- group: Create curves and surfaces using the sine equation
number_slider = Slider(45, range=1..100)  # disabled
c_script_2 = CSharpScript(num=number_slider)  # -> out, OutCurves, OutSurface, OutLoft; inputs num: Int32; disabled
# ---------- c_script_2: C# ----------
    //List of all points
    List<Point3d> allPoints = new List<Point3d>();
    //List of curves
    List<Curve> curves = new List<Curve>();

    for(int y = 0; y < num; y++)
    {
      //Curve points
      List<Point3d> crvPoints = new List<Point3d>();
      for(int x = 0; x < num; x++)
      {
        double z = Math.Sin(Math.PI / 180 + (x + y));
        Point3d pt = new Point3d(x, y, z);
        crvPoints.Add(pt);
        allPoints.Add(pt);
      }

      //Create a degree 3 nurbs curve from control points
      Curve crv = Curve.CreateControlPointCurve(crvPoints, 3);
      curves.Add(crv);
    }

    //Create a nurbs surface from control points
    NurbsSurface srf = NurbsSurface.CreateFromPoints(allPoints, num, num, 3, 3);
    //Create a loft brep from curves
    Brep[] breps = Brep.CreateFromLoft(curves, Point3d.Unset, Point3d.Unset, LoftType.Tight, false);

    //Assign the outputs
    OutCurves = curves;
    OutSurface = srf;
    OutLoft = breps;
# ---------- end c_script_2 ----------
geometry = Geometry(c_script_2.OutCurves)  # disabled
geometry_2 = Geometry(c_script_2.OutLoft)  # disabled
geometry_3 = Geometry(c_script_2.OutSurface)  # disabled

# ---- group: De Casteljau algorithm to draw a Bezier Curve with 2, 4, 8, and 16 segments
number_slider_2 = Slider(16, range=2..16)  # disabled
point = Point(Point(-40, 13, 0))  # disabled
point_2 = Point(Point(-17, 0, 0))  # disabled
point_3 = Point(Point(-40, 0, 0))  # disabled
point_4 = Point(Point(-25, 11, 0))  # disabled
c_script_3 = CSharpScript(pt0=point_3, pt1=point, pt2=point_4, pt3=point_2, segments=number_slider_2)  # -> out, BezierCrv; inputs pt0: Point3d, pt1: Point3d, pt2: Point3d, pt3: Point3d, segments: Int32; disabled
# ---------- c_script_3: C# ----------
    if (segments < 2)
      segments = 2;

    List <Point3d> bezierPts = new List<Point3d>();
    bezierPts.Add(pt0);
    bezierPts.Add(pt1);
    bezierPts.Add(pt2);
    bezierPts.Add(pt3);

    List<Point3d> evalPts = new List<Point3d>();
    double step = 1 / (double) segments;
    for(int i = 0;i <= segments;i++)
    {
      double t = i * step;
      Point3d pt = Point3d.Unset;
      EvalPoint(bezierPts, t, ref pt);

      if(pt.IsValid)
        evalPts.Add(pt);
    }

    Polyline pline = new Polyline(evalPts);
    BezierCrv = pline;
# ---------- c_script_3: C# additional code ----------
  void EvalPoint(List<Point3d> points, double t, ref Point3d evalPt)
  {
    //Stopping condition - point at parameter "t" is found
    if(points.Count < 2)
      return;
    List <Point3d> tPoints = new List<Point3d>();
    for(int i = 1; i < points.Count; i++)
    {
      Line line = new Line(points[i - 1], points[i]);
      Point3d pt = line.PointAt(t);
      tPoints.Add(pt);
    }

    if(tPoints.Count == 1)
      evalPt = tPoints[0];
    EvalPoint(tPoints, t, ref evalPt);
  }
# ---------- end c_script_3 ----------
geometry_4 = Geometry(c_script_3.BezierCrv)  # disabled
