# Grasshopper definition Chernobyl_Building.gh (Grasshopper 1.0.7)

# ---- group: Cutter
xy_plane = XYPlane(Origin=Point(0, 0, 0))
xz_plane = XZPlane(Origin=Point(0, 0, 0))
rotate = Rotate(Geometry=xy_plane, Angle=degrees(Slider(31, range=0..100)), Plane=xz_plane)  # -> Geometry, Transform
unit_x = UnitX(Factor=Slider(77, range=0..100))
plane_surface = PlaneSurface(Plane=rotate.Geometry, XSize=Domain(-10, 10), YSize=Domain(-10, 10))
move = Move(Geometry=plane_surface, Motion=unit_x)  # -> Geometry, Transform
unit_z = UnitZ(Factor=Slider(-2, range=-10..10))
move_2 = Move(Geometry=move.Geometry, Motion=unit_z)  # -> Geometry, Transform

# ----
xy_plane_2 = XYPlane(Origin=Point(0, 0, 0))
xz_plane_2 = XZPlane(Origin=Point(0, 0, 0))
rotate_2 = Rotate(Geometry=xy_plane_2, Angle=degrees(Slider(141, range=0..300)), Plane=xz_plane_2)  # -> Geometry, Transform
unit_x_2 = UnitX(Factor=Slider(146, range=0..300))
plane_surface_2 = PlaneSurface(Plane=rotate_2.Geometry, XSize=Domain(-10, 10), YSize=Domain(-10, 10))
move_3 = Move(Geometry=plane_surface_2, Motion=unit_x_2)  # -> Geometry, Transform
unit_z_2 = UnitZ(Factor=Slider(-2, range=-10..10))
move_4 = Move(Geometry=move_3.Geometry, Motion=unit_z_2)  # -> Geometry, Transform

# ---- group: 2/5 of Downer Right Wing
construct_point = ConstructPoint(
    XCoordinate=Slider(174.3, range=-100..300),
    YCoordinate=Slider(0, range=-100..100),
    ZCoordinate=Slider(0, range=-100..100))
construct_point_2 = ConstructPoint(XCoordinate=Slider(143.45, range=-100..300), YCoordinate=0, ZCoordinate=Slider(-6.2, range=-100..100))
box_2pt = Box2Pt(PointA=construct_point, PointB=construct_point_2, Plane=PlaneXY(0, 0, 0))

# ---- group: Rectangle to be cut
construct_point_3 = ConstructPoint(
    XCoordinate=Slider(70, range=-100..300),
    YCoordinate=Slider(0, range=-100..100),
    ZCoordinate=Slider(-6.2, range=-100..100))
construct_point_4 = ConstructPoint(XCoordinate=Slider(80.4, range=-100..300), YCoordinate=0, ZCoordinate=Slider(0, range=-100..100))
box_2pt_2 = Box2Pt(PointA=construct_point_3, PointB=construct_point_4, Plane=PlaneXY(0, 0, 0))

# ---- group: Top Part
construct_point_5 = ConstructPoint(
    XCoordinate=Slider(91.45, range=-100..300),
    YCoordinate=Slider(0, range=-100..100),
    ZCoordinate=Slider(49.6, range=-100..100))
construct_point_6 = ConstructPoint(XCoordinate=Slider(123.45, range=-100..300), YCoordinate=0, ZCoordinate=Slider(71.5, range=-100..100))
box_2pt_3 = Box2Pt(PointA=construct_point_5, PointB=construct_point_6, Plane=PlaneXY(0, 0, 0))

# ---- group: Right compound
construct_point_7 = ConstructPoint(
    XCoordinate=Slider(191.45, range=-100..300),
    YCoordinate=Slider(0, range=-100..100),
    ZCoordinate=Slider(0, range=-100..100))
construct_point_8 = ConstructPoint(XCoordinate=Slider(143.45, range=-100..300), YCoordinate=0, ZCoordinate=Slider(21.5, range=-100..100))
box_2pt_4 = Box2Pt(PointA=construct_point_7, PointB=construct_point_8, Plane=PlaneXY(0, 0, 0))

# ---- group: Middle Wing
construct_point_9 = ConstructPoint(XCoordinate=Slider(70, range=-100..100), YCoordinate=Slider(0, range=-100..100), ZCoordinate=Slider(0, range=-100..100))
construct_point_10 = ConstructPoint(XCoordinate=Slider(143.45, range=-100..300), YCoordinate=0, ZCoordinate=Slider(49.6, range=-100..100))
box_2pt_5 = Box2Pt(PointA=construct_point_9, PointB=construct_point_10, Plane=PlaneXY(0, 0, 0))

# ---- group: Left Wing
construct_point_11 = ConstructPoint(
    XCoordinate=Slider(0, range=-100..100),
    YCoordinate=Slider(0, range=-100..100),
    ZCoordinate=Slider(-6.2, range=-100..100))
construct_point_12 = ConstructPoint(XCoordinate=Slider(51, range=-100..100), YCoordinate=0, ZCoordinate=Slider(32.7, range=-100..100))
box_2pt_6 = Box2Pt(PointA=construct_point_11, PointB=construct_point_12, Plane=PlaneXY(0, 0, 0))

# ---- group: Middle Left Wing
construct_point_13 = ConstructPoint(
    XCoordinate=Slider(51, range=-100..100),
    YCoordinate=Slider(0, range=-100..100),
    ZCoordinate=Slider(-6.2, range=-100..100))
construct_point_14 = ConstructPoint(XCoordinate=Slider(64, range=-100..100), YCoordinate=0, ZCoordinate=Slider(37.9, range=-100..100))
box_2pt_7 = Box2Pt(PointA=construct_point_13, PointB=construct_point_14, Plane=PlaneXY(0, 0, 0))

# ---- group: Next to Middle Wing part with triangle
construct_point_15 = ConstructPoint(
    XCoordinate=Slider(64, range=-100..100),
    YCoordinate=Slider(0, range=-100..100),
    ZCoordinate=Slider(-6.2, range=-100..100))
construct_point_16 = ConstructPoint(XCoordinate=Slider(70, range=-100..100), YCoordinate=0, ZCoordinate=Slider(37.9, range=-100..100))
box_2pt_8 = Box2Pt(PointA=construct_point_15, PointB=construct_point_16, Plane=PlaneXY(0, 0, 0))

# ----
construct_point_17 = ConstructPoint(
    XCoordinate=Slider(174.3, range=-100..300),
    YCoordinate=Slider(0, range=-100..100),
    ZCoordinate=Slider(0, range=-100..100))
construct_point_18 = ConstructPoint(XCoordinate=Slider(184.28, range=-100..300), YCoordinate=0, ZCoordinate=Slider(-4, range=-100..100))
box_2pt_9 = Box2Pt(PointA=construct_point_17, PointB=construct_point_18, Plane=PlaneXY(0, 0, 0))
construct_point_19 = ConstructPoint(
    XCoordinate=Slider(191.45, range=-100..300),
    YCoordinate=Slider(0, range=-100..100),
    ZCoordinate=Slider(0, range=-100..100))
construct_point_20 = ConstructPoint(XCoordinate=Slider(184.28, range=-100..300), YCoordinate=0, ZCoordinate=Slider(-1.5, range=-100..100))
brep = Brep(box_2pt)
box_2pt_10 = Box2Pt(PointA=construct_point_19, PointB=construct_point_20, Plane=PlaneXY(0, 0, 0))
brep_2 = Brep(box_2pt_2)
box_rectangle = BoxRectangle(Rectangle=brep, Height=Slider(8, range=0..10))
split_brep = SplitBrep(Brep=box_rectangle, Cutter=move_4.Geometry)
box_rectangle_2 = BoxRectangle(Rectangle=brep_2, Height=Slider(8, range=0..10))
dispatch = Dispatch(List=split_brep, DispatchPattern=[True, False])  # -> ListA, ListB
split_brep_2 = SplitBrep(Brep=box_rectangle_2, Cutter=move_2.Geometry)
dispatch_2 = Dispatch(List=split_brep_2, DispatchPattern=[True, False])  # -> ListA, ListB

# ---- group: WRONG ONE DO NOT USE
geometry = Geometry(dispatch.ListA)

# ----
geometry_2 = Geometry(dispatch.ListB)
geometry_3 = Geometry(dispatch_2.ListA)

# ---- group: DO NOT USE WRONG PART
geometry_4 = Geometry(dispatch_2.ListB)

# ----
brep_3 = Brep(geometry_3)
merge = Merge(
    Data1=box_2pt_6,
    Data2=box_2pt_7,
    Data3=box_2pt_8,
    Data4=box_2pt_5,
    Data5=box_2pt_4,
    Data6=box_2pt_3,
    Data7=box_2pt_9,
    Data8=box_2pt_10)
brep_4 = Brep(merge)
box_rectangle_3 = BoxRectangle(Rectangle=brep_4, Height=Slider(8, range=0..10))
merge_2 = Merge(Data1=box_rectangle_3, Data2=brep_3, Data3=geometry_2)
