# Grasshopper definition SAM_Introduction.gh (Grasshopper 1.0.7)
# plug-ins: SAM, SAM.Analytical.Grasshopper.LadybugTools

panel = Panel("""Wall
Floor""")
geometry = Geometry(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)
geometry_2 = Geometry([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])
# We are taking the Rhino Geometry and translating it into SAM.
samanalytical_createpanel = SAMAnalyticalCreatePanel(_geometry=flatten(geometry_2), Simplify_=True, MinArea_=0.001)
geometry_3 = Geometry(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)
# We are making an aperature in the model.
samanalytical_addaperture = SAMAnalyticalAddAperture(_geometry=geometry_3, _panel=flatten(samanalytical_createpanel), MaxDistance_=0.1, _trimGeometry_=True, MinArea_=0.001)  # -> Panels, Apertures
panel_2 = Panel(samanalytical_createpanel)
# Here we are making a space, cells.
panel_3 = Panel(samanalytical_addaperture.Panels)
samanalytical_createadjacencycluster = SAMAnalyticalCreateAdjacencyCluster(
    _panels=flatten(samanalytical_addaperture.Panels),
    _tolerance_=0.001,
    _tryCellComplexByCells_=False,
    MinArea_=0.001,
    _run_=Toggle(True))  # -> AdjacencyCluster, Topology, Panels, Spaces, InternalPanels, ExternalPanels, ShadingPanels, Sucessfull
getvalue = GetValue(_object=samanalytical_createadjacencycluster.Spaces, _name="Name")
samadjacencycluster_adjacencyinformation = SAMAdjacencyClusterAdjacencyInformation(_adjacencyCluster=samanalytical_createadjacencycluster.AdjacencyCluster)  # -> Panels, PanelTypes, Geometries, SpaceAdjNames
topology_adjacencies = TopologyAdjacencies(
    _adjacencyCluster=samanalytical_createadjacencycluster.AdjacencyCluster,
    _SAMAnalytical=samanalytical_createadjacencycluster.Spaces)
panel_4 = Panel(samadjacencycluster_adjacencyinformation.Panels)
samanalytical_hbface = SAMAnalyticalHBFace(_panel=topology_adjacencies)
ghpython_script = GhPythonScript(face_str=samanalytical_hbface)  # -> face
# ---------- ghpython_script: Python ----------
__author__ = "micha"
__version__ = "2020.03.21"

import rhinoscriptsyntax as rs
import json
from honeybee.face import Face

if face_str:
    face_dict = json.loads(face_str)
    face = Face.from_dict(face_dict)
# ---------- end ghpython_script ----------
panel_5 = Panel(ghpython_script)
room = HBRoom(faces=ghpython_script, name=graft(getvalue), conditioned=True)  # -> out, simplify(room); plug-in component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
model = HBModel(rooms=flatten(room.room), name="MichalinaTower")  # -> out, model; plug-in component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
boolean_toggle = BooleanToggle(True)
file_path = FilePath("C:\EnergyPlusV9-1-0\WeatherData\USA_CA_San.Francisco.Intl.AP.724940_TMY3.epw")
modeltoidf = HBModelToIDF(model=model.model, epw_file=file_path, write=boolean_toggle, run=boolean_toggle)  # -> out, idf, sql, zsz, rdd, html; plug-in component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
