# Grasshopper definition Grid.gh (Grasshopper 1.0.7)
# plug-ins: Bifocals

number_slider = Slider(50, range=0..100)
number_slider_2 = Slider(26, range=0..100)
rectangle = Rectangle(Plane=PlaneXY(0, 0, 0), XSize=number_slider, YSize=number_slider, Radius=0)  # -> Rectangle, Length
square = Square(Plane=PlaneXY(0, 0, 0), Size=Slider(0.9, range=0..1), ExtentX=number_slider_2, ExtentY=number_slider_2)  # -> Cells, Points
boundary_surfaces = BoundarySurfaces(Edges=rectangle.Rectangle)
divide_surface = DivideSurface(Surface=boundary_surfaces, UCount=10, VCount=10)  # -> Points, Normals, Parameters
divide_curve = DivideCurve(Curve=boundary_surfaces, Count=Slider(55.55555556, range=0..100), Kinks=False)  # -> Points, Tangents, Parameters
isotrim = Isotrim(Surface=boundary_surfaces, Domain=divide_curve.Points)
# we want the user to pick how big the square/rectangle is in example choose the measurments for x and y. Then how big the whole figure should be. the program divides the hugness of the square by the individual measurements of a square. To create you "perfect" grid.
cone = Cone(Base=PlaneXY(0, 0, 0), Radius=0.5, Length=1)  # -> Cone, Tip
