# Grasshopper definition Ordering_Squares.gh (Grasshopper 1.0.7)
# plug-ins: Bifocals

number_slider = Slider(5, range=5..10)
construct_domain = ConstructDomain(DomainStart=Slider(2, range=2..8), DomainEnd=Slider(8, range=2..8))
random = Random(Range=construct_domain, Number=number_slider, Seed=Slider(3.08, range=0..10))
series = Series(Start=0, Step=Slider(10, range=2..10), Count=number_slider)
construct_point = ConstructPoint(XCoordinate=series, YCoordinate=Slider(26.11, range=0..100), ZCoordinate=0)
panel = Panel(random)
construct_point_2 = ConstructPoint(XCoordinate=series, YCoordinate=Slider(26.11, range=0..100), ZCoordinate=0)
rectangle = Rectangle(Plane=construct_point, XSize=random, YSize=random, Radius=0)  # -> Rectangle, Length
xy_plane = XYPlane(Origin=construct_point_2)
area = Area(Geometry=rectangle.Rectangle)  # -> Area, Centroid
panel_2 = Panel(rectangle.Length)
sort_list = SortList(Keys=panel_2, ValuesA=rectangle.Rectangle)  # -> Keys, ValuesA
area_2 = Area(Geometry=sort_list.ValuesA)  # -> Area, Centroid
panel_3 = Panel(sort_list.Keys)
orient = Orient(Geometry=sort_list.ValuesA, Source=area_2.Centroid, Target=xy_plane)  # -> Geometry, Transform
brep_wireframe = BrepWireframe(Brep=orient.Geometry, Density=-1)
list_item = ListItem(List=brep_wireframe, Index=0, Wrap=True)  # -> Item1, Item, Item1_2
