# Grasshopper definition AddApertures_Bug.gh (Grasshopper 1.0.7)
# plug-ins: TopologicGH, SAM

geometry = Geometry(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)
geometry_2 = Geometry([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])
topology_bygeometry = TopologyByGeometry(Geometry=geometry, Tolerance=0.0001)
topology_bygeometry_2 = TopologyByGeometry(Geometry=geometry_2, Tolerance=0.0001)
panel = Panel(topology_bygeometry)
panel_2 = Panel(topology_bygeometry_2)
face_bywire = FaceByWire(Wire=topology_bygeometry_2)
cluster_bytopologies = ClusterByTopologies(Topologies=face_bywire)
geometry_3 = Geometry(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)
topology_slice = TopologySlice(Topology=topology_bygeometry, Tool=cluster_bytopologies, TransferDictionary=False)

# ---- group: Only outer faces of cellcomplex
geometry_4 = Geometry([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])

# ----
geometry_5 = Geometry([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])
topology_bygeometry_3 = TopologyByGeometry(Geometry=geometry_3, Tolerance=0.0001)
geometry_6 = Geometry([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])
topology_bygeometry_4 = TopologyByGeometry(Geometry=geometry_4, Tolerance=0.0001)
topology_bygeometry_5 = TopologyByGeometry(Geometry=geometry_6, Tolerance=0.0001)
topology_bygeometry_6 = TopologyByGeometry(Geometry=geometry_5, Tolerance=0.0001)
topology_impose = TopologyImpose(Topology=topology_slice, Tool=topology_bygeometry_3, TransferDictionary=False)
cluster_bytopologies_2 = ClusterByTopologies(Topologies=topology_bygeometry_5)
topology_addapertures = TopologyAddApertures(Topology=topology_bygeometry_4, ApertureTopologies=topology_bygeometry_6)
cell_externalboundary = CellExternalBoundary()
sort_list = SortList()  # -> Keys, ValuesA
topology_slice_2 = TopologySlice(Topology=topology_impose, Tool=cluster_bytopologies_2, TransferDictionary=False)
topology_faces = TopologyFaces(Topology=topology_slice_2)
topology_apertures = TopologyApertures(Topology=topology_addapertures)
face_type = FaceType()
cell_adjacentcells = CellAdjacentCells()
faceutility_adjacentcells = FaceUtilityAdjacentCells(Face=topology_faces, ParentTopology=topology_slice_2)  # -> simplify(Cells)
cellcomplex_externalboundary = CellComplexExternalBoundary(CellComplex=topology_slice_2)
cellcomplex_internalboundaries = CellComplexInternalBoundaries(CellComplex=topology_slice_2)

topology_faces_2 = TopologyFaces(Topology=topology_slice_2)
list_item = ListItem(List=topology_faces_2, Index=Slider(31, range=1..150), Wrap=True)
geometry_7 = Geometry(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)
topology_bygeometry_7 = TopologyByGeometry(Geometry=geometry_7, Tolerance=0.0001)
topology_addapertures_2 = TopologyAddApertures(Topology=list_item, ApertureTopologies=topology_bygeometry_7)
topology_typeasstring = TopologyTypeAsString(Topology=topology_bygeometry_7)
panel_3 = Panel(topology_typeasstring)
topology_apertures_2 = TopologyApertures(Topology=topology_addapertures_2)
topology_geometry = TopologyGeometry(Topology=topology_addapertures_2, Tolerance=0.0001)
geometry_8 = Geometry(topology_geometry)

list_length = ListLength(List=faceutility_adjacentcells)
equality = Equality(FirstNumber=list_length, SecondNumber=Slider(1, range=0..1))  # -> Equality, Inequality
dispatch = Dispatch(List=topology_faces, DispatchPattern=flatten(equality.Equality))  # -> ListA, ListB
topology_centroid = TopologyCentroid(Topology=dispatch.ListA)
faceutility_parametersatvertex = FaceUtilityParametersAtVertex(Face=dispatch.ListA, Vertex=topology_centroid)  # -> U, V
cell_faces = CellFaces(Cell=cellcomplex_externalboundary)
face_externalboundary = FaceExternalBoundary(Face=cell_faces)
faceutility_normalatparameters = FaceUtilityNormalAtParameters(Face=dispatch.ListA, U=faceutility_parametersatvertex.U, V=faceutility_parametersatvertex.V)  # -> X, Y, Z

topology_geometry_2 = TopologyGeometry(Topology=dispatch.ListA, Tolerance=0.0001)  # -> flatten(Geometry)
area = Area(Geometry=topology_geometry_2)  # -> Area, Centroid
evaluate_surface = EvaluateSurface(Surface=topology_geometry_2, Point=area.Centroid)  # -> Point, Normal, UDirection, VDirection, Frame
deconstruct = Deconstruct(Point=evaluate_surface.Normal)  # -> XComponent, YComponent, ZComponent
panel_4 = Panel(evaluate_surface.Normal)
dispatch_2 = Dispatch(List=topology_geometry_2, DispatchPattern=flatten(faceutility_normalatparameters.Z))  # -> ListA, ListB
geometry_9 = Geometry(dispatch_2.ListA)

construct_domain = ConstructDomain(DomainStart=Slider(0, range=0..100), DomainEnd=Slider(4, range=0..10))
construct_domain_2 = ConstructDomain(DomainStart=Slider(5, range=0..10), DomainEnd=Slider(28, range=0..100))
plane_normal = PlaneNormal(Origin=Point(0, 0, 0), ZAxis=Vector(0, 0, 1))
sub_list = SubList(List=cell_faces, Domain=construct_domain, Wrap=True)  # -> List, Index
sub_list_2 = SubList(List=cell_faces, Domain=construct_domain_2, Wrap=True)  # -> List, Index
geometry_10 = Geometry([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])
construct_domain_3 = ConstructDomain(DomainStart=Slider(29, range=0..100), DomainEnd=Slider(33, range=0..100))
topology_geometry_3 = TopologyGeometry(Topology=sub_list_2.List, Tolerance=0.0001)
topology_bygeometry_8 = TopologyByGeometry(Geometry=geometry_10, Tolerance=0.0001)
sub_list_3 = SubList(List=cell_faces, Domain=construct_domain_3, Wrap=True)  # -> List, Index
topology_addapertures_3 = TopologyAddApertures(Topology=sub_list_2.List, ApertureTopologies=topology_bygeometry_8)
replace_items = ReplaceItems(Wrap=False)
number_slider = Slider(0, range=0..25)
number_slider_2 = Slider(35, range=35..50)
topology_apertures_3 = TopologyApertures(Topology=topology_addapertures_3)
list_item_2 = ListItem(List=cell_faces, Index=Slider(34, range=26..50), Wrap=True)
merge = Merge(Data1=cellcomplex_internalboundaries, Data2=topology_addapertures_3, Data3=sub_list.List, Data4=sub_list_3.List)  # -> flatten(Result)
topology_geometry_4 = TopologyGeometry(Topology=merge, Tolerance=0.0001)
topology_geometry_5 = TopologyGeometry(Topology=list_item_2, Tolerance=0.0001)
topology_samgeometry = TopologySAMGeometry(_topology=merge, SAM_ComponentVersion="1.0.0")
topology_analyze = TopologyAnalyze(Topology=merge)
topology_analyze_2 = TopologyAnalyze(_topology=merge, SAM_ComponentVersion="1.0.0")
topology_geometry_6 = TopologyGeometry(Topology=merge, Tolerance=0.0001)
samanalytical_createpanelby3dgeometry = SAMAnalyticalCreatePanelBy3DGeometry(
    _3Dgeometry=flatten(topology_samgeometry),
    Simplify_=True,
    MinArea_=0.001,
    Tolerance_=1e-06,
    SAM_ComponentVersion="1.0.1")
geometry_11 = Geometry(topology_geometry_6)
samanalytical_mergeoverlappanels = SAMAnalyticalMergeOverlapPanels(
    _analyticalObject=flatten(samanalytical_createpanelby3dgeometry),
    _offset_=1e-06,
    _defaultConstruction_=False,
    _tolerance_=1e-06,
    _run=True,
    SAM_ComponentVersion="1.0.0")  # -> AnalyticalObject, RedundantPanels
cellcomplex_byfaces = CellComplexByFaces(Faces=merge, Tolerance=Slider(0.01, range=0..0.01))
topology_apertures_4 = TopologyApertures(Topology=merge)  # -> flatten(Apertures)
create_samadjacencycluster = CreateSAMAdjacencyCluster(
    _panels=flatten(samanalytical_mergeoverlappanels.AnalyticalObject),
    Tolerance_=0.0001,
    TryCellComplexByCells_=False,
    MinArea_=0.001,
    SilverSpacing_=0.001,
    _run=True,
    SAM_ComponentVersion="1.0.0")  # -> AdjacencyCluster, Topologies, Panels, Spaces, InternalPanels, ExternalPanels, ShadingPanels, RedundantPanels, Log, Sucessfull
list_item_3 = ListItem(List=flatten(topology_apertures_4), Index=Slider(28, range=1..49), Wrap=True)
topology_geometry_7 = TopologyGeometry(Topology=list_item_3, Tolerance=0.0001)
panel_5 = Panel(create_samadjacencycluster.ExternalPanels, SAM_Analytical_Grasshopper_GooPanelParam=True)
