# Grasshopper definition Building_Boxes_Then_Bug#2.gh (Grasshopper 1.0.7)
# plug-ins: TopologicGH

geometry = Geometry([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])
deconstruct_brep = DeconstructBrep(Brep=geometry)  # -> Faces, Edges, Vertices
geometry_2 = Geometry(deconstruct_brep.Edges)
topology_bygeometry = TopologyByGeometry(Geometry=flatten(deconstruct_brep.Faces), Tolerance=0.0001)
cellcomplex_byfaces = CellComplexByFaces(Faces=topology_bygeometry, Tolerance=0.001)
topology_cells = TopologyCells(Topology=cellcomplex_byfaces)
topology_analyze = TopologyAnalyze(Topology=cellcomplex_byfaces)
list_item = ListItem(List=topology_cells, Index=Slider(10, range=0..10), Wrap=True)
topology_geometry = TopologyGeometry(Topology=list_item, Tolerance=0.0001)
