# Grasshopper definition Building_Boxes_Then_Bug.gh (Grasshopper 1.0.7)
# plug-ins: TopologicGH, Bifocals

construct_point = ConstructPoint(XCoordinate=Slider(5, range=-100..100), YCoordinate=Slider(-2, range=-100..100), ZCoordinate=0)
construct_point_2 = ConstructPoint(XCoordinate=Slider(0, range=-100..100), YCoordinate=Slider(0, range=-100..100), ZCoordinate=0)
construct_point_3 = ConstructPoint(XCoordinate=Slider(10, range=0..100), YCoordinate=Slider(3, range=0..100), ZCoordinate=0)
construct_point_4 = ConstructPoint(XCoordinate=Slider(15, range=0..100), YCoordinate=Slider(9, range=0..100), ZCoordinate=0)
box_2pt = Box2Pt(PointA=construct_point, PointB=construct_point_3, Plane=PlaneXY(0, 0, 0))
box_2pt_2 = Box2Pt(PointA=construct_point_2, PointB=construct_point_4, Plane=PlaneXY(0, 0, 0))
unit_y = UnitY(Factor=Slider(-27, range=-100..100))
move = Move(Geometry=box_2pt, Motion=unit_y)  # -> Geometry, Transform
box_rectangle = BoxRectangle(Rectangle=box_2pt_2, Height=Slider(3, range=0..10))
unit_y_2 = UnitY(Factor=Slider(-9, range=-100..100))
box_rectangle_2 = BoxRectangle(Rectangle=move.Geometry, Height=Slider(7, range=0..10))
unit_y_3 = UnitY(Factor=Slider(18, range=0..100))
move_2 = Move(Geometry=box_rectangle, Motion=unit_y_2)  # -> Geometry, Transform
move_3 = Move(Geometry=box_rectangle_2, Motion=unit_y_3)  # -> Geometry, Transform
brep_join = BrepJoin(Breps=[move_3.Geometry, move_2.Geometry])  # -> Breps, Closed
deconstruct_brep = DeconstructBrep(Brep=brep_join.Breps)  # -> Faces, Edges, Vertices
topology_bygeometry = TopologyByGeometry(Geometry=deconstruct_brep.Faces, Tolerance=0.0001)  # -> flatten(Topology)
panel = Panel(topology_bygeometry)
cellcomplex_byfaces = CellComplexByFaces(Faces=topology_bygeometry, Tolerance=0.001)
cluster_bytopologies = ClusterByTopologies(Topologies=topology_bygeometry)
topology_geometry = TopologyGeometry(Topology=topology_bygeometry, Tolerance=0.0001)
topology_selfmerge = TopologySelfMerge(Topology=cluster_bytopologies)
topology_analyze = TopologyAnalyze(Topology=topology_selfmerge)
panel_2 = Panel(topology_selfmerge)
panel_3 = Panel(topology_analyze)
