# Grasshopper definition micha_tutorial_1.gh (Grasshopper 1.0.7)
# plug-ins: TopologicGH

geometry = Geometry(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)
geometry_2 = Geometry([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])
topology_bygeometry = TopologyByGeometry(Geometry=geometry, Tolerance=0.0001)
topology_bygeometry_2 = TopologyByGeometry(Geometry=geometry_2, Tolerance=0.0001)
cluster_bytopologies = ClusterByTopologies(Topologies=topology_bygeometry_2)
topology_slice = TopologySlice(Topology=topology_bygeometry, Tool=cluster_bytopologies, TransferDictionary=False)
cellcomplex_faces = CellComplexFaces(CellComplex=topology_slice)
topology_centroid = TopologyCentroid(Topology=cellcomplex_faces)
faceutility_parametersatvertex = FaceUtilityParametersAtVertex(Face=cellcomplex_faces, Vertex=topology_centroid)  # -> U, V
faceutility_normalatparameters = FaceUtilityNormalAtParameters(Face=cellcomplex_faces, U=faceutility_parametersatvertex.U, V=faceutility_parametersatvertex.V)  # -> X, Y, Z
absolute = Absolute(Value=faceutility_normalatparameters.Z)
geometry_3 = Geometry([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])
dispatch = Dispatch(List=cellcomplex_faces, DispatchPattern=absolute)  # -> ListA, ListB
topology_geometry = TopologyGeometry(Topology=dispatch.ListB, Tolerance=0.0001)  # -> flatten(Geometry)
area = Area(Geometry=topology_geometry)  # -> Area, Centroid
scale = Scale(Geometry=topology_geometry, Center=area.Centroid, Factor=Slider(0.5, range=0..1))  # -> Geometry, Transform
topology_bygeometry_3 = TopologyByGeometry(Geometry=scale.Geometry, Tolerance=0.0001)
topology_addapertures = TopologyAddApertures(Topology=dispatch.ListB, ApertureTopologies=topology_bygeometry_3)
merge = Merge(Data1=dispatch.ListA, Data2=topology_addapertures)
topology_apertures = TopologyApertures(Topology=merge)  # -> flatten(Apertures)
topology_geometry_2 = TopologyGeometry(Topology=topology_apertures, Tolerance=0.0001)
cellcomplex_byfaces = CellComplexByFaces(Faces=merge, Tolerance=0.001)
panel = Panel(topology_apertures)
