# Grasshopper definition Triangle_from_Scratch_project.gh (Grasshopper 1.0.7)

# ---- group: Main square out of triangles
construct_point = ConstructPoint(XCoordinate=Slider(0, range=0..10), YCoordinate=Slider(10, range=0..11), ZCoordinate=0)
construct_point_2 = ConstructPoint(XCoordinate=Slider(10, range=0..10), YCoordinate=0, ZCoordinate=0)
construct_point_3 = ConstructPoint(XCoordinate=0, YCoordinate=0, ZCoordinate=0)
construct_point_4 = ConstructPoint(XCoordinate=Slider(5, range=0..10), YCoordinate=Slider(5, range=0..10), ZCoordinate=0)
construct_point_5 = ConstructPoint(XCoordinate=Slider(10, range=0..10), YCoordinate=Slider(10, range=0..11), ZCoordinate=0)
construct_point_6 = ConstructPoint(XCoordinate=Slider(5, range=0..10), YCoordinate=Slider(5, range=0..10), ZCoordinate=0)
line = Line(StartPoint=construct_point_5, EndPoint=construct_point)
line_2 = Line(StartPoint=construct_point_5, EndPoint=construct_point_6)
line_3 = Line(StartPoint=construct_point, EndPoint=construct_point_6)
line_4 = Line(StartPoint=construct_point_2, EndPoint=construct_point_3)
line_5 = Line(StartPoint=construct_point_3, EndPoint=construct_point_4)
line_6 = Line(StartPoint=construct_point_2, EndPoint=construct_point_4)
line_7 = Line(StartPoint=construct_point_3, EndPoint=construct_point)
merge = Merge(Data2=line_4, Data3=line_5, Data4=line_6)
merge_2 = Merge(Data2=line, Data3=line_3, Data4=line_2)
merge_3 = Merge(Data1=line_5, Data2=line_7, Data3=line_3)
line_8 = Line(StartPoint=construct_point_2, EndPoint=construct_point_5)
merge_4 = Merge(Data1=line_8, Data2=merge, Data3=merge_3, Data4=merge_2)

# ----
negative = Negative(Value=Slider(12, range=0..20))
negative_2 = Negative(Value=Slider(11, range=0..20))
negative_3 = Negative(Value=Slider(1, range=0..10))
negative_4 = Negative(Value=Slider(10, range=0..10))
construct_point_7 = ConstructPoint(XCoordinate=negative_4, YCoordinate=0, ZCoordinate=0)
construct_point_8 = ConstructPoint(XCoordinate=negative, YCoordinate=0, ZCoordinate=0)
construct_point_9 = ConstructPoint(XCoordinate=negative_2, YCoordinate=negative_3, ZCoordinate=0)
line_9 = Line(StartPoint=construct_point_7, EndPoint=construct_point_8)
line_10 = Line(StartPoint=construct_point_8, EndPoint=construct_point_9)
line_11 = Line(StartPoint=construct_point_7, EndPoint=construct_point_9)
merge_5 = Merge(Data1=line_9, Data2=line_11, Data3=line_10)
xy_plane = XYPlane(Origin=Point(0, 0, 0))
rotate = Rotate(Geometry=merge_5, Angle=degrees(Slider(90, range=0..100)), Plane=xy_plane)  # -> Geometry, Transform
unit_y = UnitY(Factor=Slider(16, range=0..100))
move = Move(Geometry=rotate.Geometry, Motion=unit_y)  # -> Geometry, Transform
unit_x = UnitX(Factor=Slider(1, range=0..10))
unit_x_2 = UnitX(Factor=Slider(10, range=0..100))
unit_y_2 = UnitY(Factor=Slider(10, range=0..100))
unit_y_3 = UnitY(Factor=Slider(10, range=0..100))
unit_x_3 = UnitX(Factor=Slider(10, range=0..100))

# ---- group: First triangle from left
move_2 = Move(Geometry=move.Geometry, Motion=unit_x)  # -> Geometry, Transform

# ----
rotate_2 = Rotate(Geometry=move_2.Geometry, Angle=degrees(Slider(180, range=0..1000)), Plane=PlaneXY(0, 0, 0))  # -> Geometry, Transform
move_3 = Move(Geometry=rotate_2.Geometry, Motion=unit_x_2)  # -> Geometry, Transform

# ---- group: First triangle from downwards
rotate_3 = Rotate(Geometry=move_3.Geometry, Angle=degrees(Slider(90, range=0..100)), Plane=PlaneXY(0, 0, 0))  # -> Geometry, Transform

# ---- group: First Triangle from right
move_4 = Move(Geometry=move_3.Geometry, Motion=unit_y_2)  # -> Geometry, Transform

# ----
rotate_4 = Rotate(Geometry=rotate_3.Geometry, Angle=degrees(Slider(180, range=0..1000)), Plane=PlaneXY(0, 0, 0))  # -> Geometry, Transform
move_5 = Move(Geometry=rotate_4.Geometry, Motion=unit_y_3)  # -> Geometry, Transform

# ---- group: First triangle from above
move_6 = Move(Geometry=move_5.Geometry, Motion=unit_x_3)  # -> Geometry, Transform

# ----
merge_6 = Merge(Data1=merge_4, Data2=move_4.Geometry, Data3=rotate_3.Geometry, Data4=move_6.Geometry, Data5=move_2.Geometry)
custom_preview = CustomPreview(Geometry=merge_6, Material=ColourSwatch(SwatchColor=RGB(100, 91, 164)))
